# Grasshopper definition qy光线模拟.2gh.gh (Grasshopper 1.0.7)
# plug-ins: Wallacei, GH_CPython

point = Point(<point referenced from the Rhino model>)  # disabled
point_2 = Point(<point referenced from the Rhino model>)  # disabled
point_3 = Point(<point referenced from the Rhino model>)  # disabled
point_4 = Point(<point referenced from the Rhino model>)  # disabled
line = Line(StartPoint=point, EndPoint=point_2)  # disabled
line_2 = Line(StartPoint=point_4, EndPoint=point_3)  # disabled
太阳高度角 = Slider(67, range=0..90)  # disabled
太阳高度角_2 = Slider(67, range=0..90)  # disabled
end_points = EndPoints(Curve=line)  # -> Start, End; disabled
end_points_2 = EndPoints(Curve=line_2)  # -> Start, End; disabled
unit_z = UnitZ(Factor=1)  # disabled
unit_z_2 = UnitZ(Factor=1)  # disabled

# ---- group: 找法线
divide_curve = DivideCurve(Curve=line_2, Count=1, Kinks=False)  # -> Points, Tangents, Parameters; disabled
xz_plane = XZPlane(Origin=Point(0, 0, 0))  # disabled
rotate = Rotate(Vector=divide_curve.Tangents, Axis=xz_plane, Angle=degrees(90))  # disabled
line_sdl = LineSDL(Start=divide_curve.Points, Direction=rotate, Length=40)  # disabled

# ----
xz_plane_2 = XZPlane(Origin=Point(0, 0, 0))  # disabled
yz_plane = YZPlane(Origin=Point(0, 0, 0))  # disabled

# ---- group: 找法线
# 两点设置入射线和反射线
divide_curve_2 = DivideCurve(Curve=line, Count=1, Kinks=False)  # -> Points, Tangents, Parameters; disabled
rotate_2 = Rotate(Vector=divide_curve_2.Tangents, Axis=yz_plane, Angle=degrees(90))  # disabled
line_sdl_2 = LineSDL(Start=divide_curve_2.Points, Direction=rotate_2, Length=40)  # disabled

# ----
number_slider = Slider(1000, range=0..1000)  # disabled
number_slider_2 = Slider(1000, range=0..1000)  # disabled
rotate_3 = Rotate(Vector=unit_z, Axis=yz_plane, Angle=expr("90-x", degrees(太阳高度角)))  # disabled
rotate_4 = Rotate(Vector=unit_z_2, Axis=xz_plane_2, Angle=expr("90-x", degrees(太阳高度角_2)))  # disabled

# ---- group: 入射线
line_sdl_3 = LineSDL(Start=[end_points.Start, end_points.End], Direction=rotate_3, Length=number_slider)  # disabled

line_sdl_4 = LineSDL(Start=[end_points_2.Start, end_points_2.End], Direction=rotate_4, Length=number_slider_2)  # disabled

# ---- group: 反射线
rotate_3d = Rotate3D(Geometry=line_sdl_3, Angle=degrees(180), Center=[end_points.Start, end_points.End], Axis=line_sdl_2)  # -> Geometry, Transform; disabled

rotate_3d_2 = Rotate3D(Geometry=line_sdl_4, Angle=degrees(180), Center=[end_points_2.Start, end_points_2.End], Axis=line_sdl)  # -> Geometry, Transform; disabled

# ---- group: 支撑杆1方向
伸缩杆1角度 = Slider(45, range=0..90)
unit_x = UnitX(Factor=1)
xz_plane_3 = XZPlane(Origin=Point(0, 0, 0))
rotate_5 = Rotate(Vector=unit_x, Axis=xz_plane_3, Angle=expr("-x", degrees(伸缩杆1角度)))

# ----
colour_swatch = ColourSwatch(SwatchColor=RGB(255, 85, 0))  # disabled
colour_swatch_2 = ColourSwatch(SwatchColor=RGB(0, 60, 255))  # disabled
colour_swatch_3 = ColourSwatch(SwatchColor=RGB(255, 85, 0))  # disabled
colour_swatch_4 = ColourSwatch(SwatchColor=RGB(0, 60, 255))  # disabled
custom_preview = CustomPreview(Geometry=rotate_3d.Geometry, Material=colour_swatch)  # disabled
custom_preview_2 = CustomPreview(Geometry=line_sdl_3, Material=colour_swatch_2)  # disabled
custom_preview_3 = CustomPreview(Geometry=rotate_3d_2.Geometry, Material=colour_swatch_3)  # disabled
custom_preview_4 = CustomPreview(Geometry=line_sdl_4, Material=colour_swatch_4)  # disabled
gene_pool_and_slider_shuffler = GenePoolAndSliderShuffler(BooleanButton=Button())
brep = Brep([<brep referenced from the Rhino model> x8])
目标曲线 = Curve([<curve referenced from the Rhino model> x5])
point_5 = Point(<point referenced from the Rhino model>)

目标曲线_2 = Curve([<curve referenced from the Rhino model> x10])
截面形状 = Surface(<surface referenced from the Rhino model>)

# ---- group: 内置点
point_6 = Point(Point(9.647874445, 0, 0.4749155847))
point_7 = Point(Point(9.647874445, 0, 3.510632904))

# ----
信息眼镜 = 信息眼镜(
    启动=True,
    Language=1,
    assemSet=False,
    assemboxHeight=4,
    autoHeight=True,
    cateSet=False,
    nameBoxDistance=0,
    showPlugin=False,
    中文=True)
explode = Explode(Curve=目标曲线, Recursive=True)  # -> flatten(Segments), Vertices
surface = Surface(<surface referenced from the Rhino model>)  # disabled
surface_2 = Surface(<surface referenced from the Rhino model>)
curve = Curve([目标曲线_2, explode.Segments])
月份 = Slider(6, range=1..12)
wlc_杆1 = Slider(0.2, range=0.2..0.48)
wlc_杆2 = Slider(0.2, range=0.2..0.6)

# ---- group: 返回值：杆件长度
杆1 = Slider(0.37, range=0.2..0.5)
杆2 = Slider(0.43, range=0.2..0.5)

# ----
伸缩杆1长度 = Slider(0.613, range=0..10)
end_points_3 = EndPoints(Curve=curve)  # -> Start, End
伸缩杆2长度 = Slider(0.176, range=0..10)
ladybug = Ladybug_Ladybug()  # -> out; plug-in component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
is_planar = IsPlanar(Surface=截面形状, Interior=True)  # -> Planar, Plane
point_8 = Point(<point referenced from the Rhino model>)
point_9 = Point(<point referenced from the Rhino model>)
point_10 = Point(<point referenced from the Rhino model>)
vector_2pt = Vector2Pt(PointA=end_points_3.Start, PointB=end_points_3.End, Unitize=False)  # -> Vector, Length

# ---- group: 南京市气象数据文件
open_weather_file = Ladybug_OpenEPWWeatherFile(open=Toggle(True))  # -> epwFile; plug-in component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

# ----
plane_normal = PlaneNormal(Origin=end_points_3.Start, ZAxis=vector_2pt.Vector)
orient = Orient(Geometry=截面形状, Source=is_planar.Plane, Target=plane_normal)  # -> Geometry, Transform

镜面1支撑位置 = Slider(0.5, range=0..1)
镜面1长度 = Slider(0.6, range=0..10)

galapagos = Galapagos(fitness=division_4, gene=[杆1, 杆2])
importepw = Ladybug_ImportEpw(epwFile=open_weather_file)  # -> Output, latitude, location, dryBulbTemperature, dewPointTemperature, relativeHumidity, windSpeed, windDirection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; plug-in component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
galapagos_2 = Galapagos(fitness=division_4, gene=[wlc_杆1, wlc_杆2])
yz_plane_2 = YZPlane(Origin=point_10)

# ---- group: 找镜面1支撑点
yz_plane_3 = YZPlane(Origin=point_9)
multiplication = Multiplication(A=镜面1支撑位置, B=镜面1长度)
circle = Circle(Plane=yz_plane_3, Radius=multiplication)
circle_2 = Circle(Plane=yz_plane_2, Radius=杆1)
curve_curve = CurveCurve(CurveA=circle, CurveB=circle_2)  # -> Points, ParamsA, ParamsB
deconstruct_vector = DeconstructVector(Vector=curve_curve.Points)  # -> XComponent, YComponent, ZComponent
sort_list = SortList(Keys=deconstruct_vector.YComponent, ValuesValuesA=curve_curve.Points)  # -> Keys, ValuesValuesA
list_item = ListItem(List=sort_list.ValuesValuesA, Index=0, Wrap=True)  # -> Item, Item1

# ----
extrude_along = ExtrudeAlong(Base=orient.Geometry, Curve=curve)
galapagos_3 = Galapagos(fitness=division, gene=[wlc_杆1, wlc_杆2])
月 = Slider(12, range=1..12)
时 = Slider(12, range=1..24)
日 = Slider(22, range=1..31)
series = Series(Start="1", Step=1, Count="12")

# ---- group: 镜面1方向
vector_2pt_2 = Vector2Pt(PointA=point_9, PointB=list_item.Item, Unitize=False)  # -> Vector, Length

# ----
sunpath = Ladybug_SunPath(location=importepw.location, hour=时, day=日, month=series, timeStep=1, dailyOrAnnualSunPath=True)  # -> out, sunVectors, sunAltitudes, sunAzimuths, port, sunSpheresMesh, sunPathCrvs, compassCrvs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; plug-in component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

# ---- group: 支撑杆1
line_3 = Line(StartPoint=point_10, EndPoint=list_item.Item)

# ----
number_slider_3 = Slider(1, range=0..1)

# ---- group: 镜面1
line_sdl_5 = LineSDL(Start=point_9, Direction=vector_2pt_2.Vector, Length=镜面1长度)

# ----
ghpython_script = GhPythonScript()  # -> Out, A
升降台宽度 = Slider(0.6, range=0..5)

镜面2支撑位置 = Slider(0.5, range=0..1)
镜面2长度 = Slider(0.6, range=0..10)

end_points_4 = EndPoints(Curve=line_sdl_5)  # -> Start, End
unit_vector = UnitVector(Vector=sunpath.sunVectors)
gh_cpython = GH_CPython()  # -> output
# ---------- gh_cpython: Python ----------
# -*- coding: utf-8 -*-
""" 
Python Script
Created on  Monday November 2023 10:33:44 
@author:  13370 

[desc]
Description of the plugin Here
Write here any thing... 
[/desc]

ARGUMENTS:
----------
<inp> 
    _input :[required] - [type = int] - [default = None] 
    Descripe your input here 
        * bullet point.
        * bullet point
</inp>
<inp>
    Other inputs go here ...
</inp>

RETURN:
----------
    <out>
        output_ : indicate your output description here. \n refers to a new line.
    </out>

"""
import csv

output_ = 1
# ---------- end gh_cpython ----------
point_11 = Point(sunpath.sunPositions)
panel = Panel("""38.157476
47.541607
58.466311
70.146702
78.358181
81.305069
78.020859
69.729472
58.349532
46.912568
37.850895
34.559333""")
list_item_2 = ListItem(List=panel, Index=expr("x-1", 月份), Wrap=True)
铰接点支架高 = Slider(0.2, range=0..1)

deconstruct = Deconstruct(Point=end_points_4.End)  # -> XComponent, YComponent, ZComponent
deconstruct_2 = Deconstruct(Point=point_8)  # -> XComponent, YComponent, ZComponent
subtraction = Subtraction(A=deconstruct.ZComponent, B=deconstruct_2.ZComponent, C=铰接点支架高)
line_sdl_6 = LineSDL(Start=point_8, Direction=Vector(0, 0, 1), Length=subtraction)

pipe = Pipe(Curve=line_sdl_6, Radius=0.01, Caps=1)
line_sdl_7 = LineSDL(Start=point_8, Direction=Vector(0, 0, 1), Length=expr("x/2", subtraction))
pipe_2 = Pipe(Curve=line_sdl_7, Radius=0.02, Caps=1)

unit_y = UnitY(Factor=1)
end_points_5 = EndPoints(Curve=line_sdl_6)  # -> Start, End
line_sdl_8 = LineSDL(Start=end_points_5.End, Direction=unit_y, Length=升降台宽度)
amplitude = Amplitude(Vector=expr("-x", unit_y), Amplitude=expr("x/2", 升降台宽度))

# ---- group: 升降台
move = Move(Geometry=line_sdl_8, Motion=amplitude)  # -> Geometry, Transform

# ---- group: 支撑杆2与升降台交点
point_on_curve = PointOnCurve(move.Geometry, parameter=0.5)

# ----
point_on_curve_2 = PointOnCurve(move.Geometry, parameter=1)
line_sdl_9 = LineSDL(Start=point_on_curve_2, Direction=Vector(0, 0, 1), Length=铰接点支架高)
反射板长度 = Slider(1, range=0..6)
point_on_curve_3 = PointOnCurve(line_sdl_9, parameter=1)

# ---- group: 找镜面2支撑点
yz_plane_4 = YZPlane(Origin=point_on_curve_3)
yz_plane_5 = YZPlane(Origin=point_on_curve)
circle_3 = Circle(Plane=yz_plane_5, Radius=杆2)
multiplication_2 = Multiplication(A=镜面2支撑位置, B=镜面2长度)
circle_4 = Circle(Plane=yz_plane_4, Radius=multiplication_2)
curve_curve_2 = CurveCurve(CurveA=circle_3, CurveB=circle_4)  # -> Points, ParamsA, ParamsB
deconstruct_vector_2 = DeconstructVector(Vector=curve_curve_2.Points)  # -> XComponent, YComponent, ZComponent
sort_list_2 = SortList(Keys=deconstruct_vector_2.ZComponent, ValuesValuesA=curve_curve_2.Points)  # -> Keys, reverse(ValuesValuesA)
list_item_3 = ListItem(List=sort_list_2.ValuesValuesA, Index=0, Wrap=True)  # -> Item, Item1

# ---- group: 支撑杆2
line_4 = Line(StartPoint=point_on_curve, EndPoint=list_item_3.Item)

# ----
number_slider_4 = Slider(0.2, range=0..1)
end_points_6 = EndPoints(Curve=line_4)  # -> Start, End
end_points_7 = EndPoints(Curve=line_3)  # -> Start, End
vector_2pt_3 = Vector2Pt(PointA=end_points_6.Start, PointB=end_points_6.End, Unitize=False)  # -> Vector, Length
vector_2pt_4 = Vector2Pt(PointA=end_points_7.Start, PointB=end_points_7.End, Unitize=False)  # -> Vector, Length
line_sdl_10 = LineSDL(Start=end_points_6.Start, Direction=vector_2pt_3.Vector, Length=number_slider_4)
line_sdl_11 = LineSDL(Start=end_points_7.Start, Direction=vector_2pt_4.Vector, Length=number_slider_4)
pipe_3 = Pipe(Curve=[line_sdl_11, line_sdl_10], Radius=0.02, Caps=1)

# ---- group: 镜面2方向
end_points_8 = EndPoints(Curve=line_4)  # -> Start, End
vector_2pt_5 = Vector2Pt(PointA=point_on_curve_3, PointB=end_points_8.End, Unitize=False)  # -> Vector, Length

# ---- group: 镜面2
line_sdl_12 = LineSDL(Start=point_on_curve_3, Direction=vector_2pt_5.Vector, Length=镜面2长度)

# ---- group: 入射板
unit_x_2 = UnitX(Factor=反射板长度)
reverse = Reverse(Vector=unit_x_2)
extrude = Extrude(Base=[line_sdl_12, line_sdl_5], Direction=reverse)

# ----
point_on_curve_4 = PointOnCurve(line_sdl_12, parameter=0)
move_2 = Move(Geometry=point_on_curve_4, Motion=expr("-x/2", reverse))  # -> Geometry, Transform
vector_2pt_6 = Vector2Pt(PointA=point_5, PointB=move_2.Geometry, Unitize=False)  # -> Vector, Length
move_3 = Move(Geometry=brep, Motion=vector_2pt_6.Vector)  # -> Geometry, Transform

end_points_9 = EndPoints(Curve=line_sdl_5)  # -> Start, End
pipe_4 = Pipe(Curve=[line_4, line_3], Radius=0.01, Caps=2)
end_points_10 = EndPoints(Curve=line_sdl_12)  # -> Start, End
point_12 = Point(end_points_10.Start)
point_13 = Point(end_points_9.End)
point_14 = Point(end_points_9.Start)
point_15 = Point(end_points_10.End)
extrude_2 = Extrude(Base=move.Geometry, Direction=reverse)
line_5 = Line(StartPoint=point_14, EndPoint=point_13)
line_6 = Line(StartPoint=point_12, EndPoint=point_15)
move_4 = Move(Geometry=extrude_2, Motion=expr("-x/2", reverse))  # -> Geometry, Transform
custom_preview_5 = CustomPreview(
    Geometry=[extrude_along, pipe_2, pipe, move_4.Geometry, move_3.Geometry],
    Material=ColourSwatch(SwatchColor=RGB(148, 148, 148)))
move_5 = Move(Geometry=extrude, Motion=expr("-x/2", reverse))  # -> Geometry, Transform
move_6 = Move(Geometry=line_6, Motion=reverse)  # -> Geometry, Transform
move_7 = Move(Geometry=line_5, Motion=reverse)  # -> Geometry, Transform
太阳高度角_3 = Slider(81, range=0..90)
entwine = Entwine(Branch00=[move_7.Geometry, line_5], Branch01=[move_6.Geometry, line_6], FlattenInputs=True)

# ---- group: 两点设置入射反射线 / 找法线
yz_plane_6 = YZPlane(Origin=Point(0, 0, 0))
divide_curve_3 = DivideCurve(Curve=entwine, Count=1, Kinks=False)  # -> Points, Tangents, Parameters
rotate_6 = Rotate(Vector=divide_curve_3.Tangents, Axis=yz_plane_6, Angle=degrees(-90))
line_sdl_13 = LineSDL(Start=divide_curve_3.Points, Direction=rotate_6, Length=40)

# ----
panel_2 = Panel(line_sdl_13)
is_planar_2 = IsPlanar(Surface=surface_2, Interior=True)  # -> Planar, Plane
ghpython_script_2 = GhPythonScript()  # -> out, a; inputs pts: Point3d
# ---------- ghpython_script_2: Python ----------
__author__ = "13370"
__version__ = "2023.11.15"

import rhinoscriptsyntax as rs
import Rhino.Geometry as rg


def get_quadrangle_from_random4_points(pts):
    #无序点得到四边形
    pts.sort(key = lambda pt:pt.X) #根据点的X坐标进行初次筛选
    vec0 = pts[1] - pts[0]
    vec1 = pts[2] - pts[1]
    vec2 = pts[3] - pts[1]
    if rg.Vector3d.VectorAngle(vec0,vec1) > rg.Vector3d.VectorAngle(vec0,vec2):#比较向量夹角
        pts[-1],pts[-2] = pts[-2],pts[-1]
        return get_quadrangle_from_sorted_points(pts)
    return get_quadrangle_from_sorted_points(pts)


def get_quadrangle_from_sorted_points(pts):
    #有序点得到四边形
    pl=rg.PolylineCurve(pts)
    pt_start=pl.PointAtStart
    pt_end=pl.PointAtEnd 
    
    return rg.Curve.JoinCurves([pl,rg.PolylineCurve([pt_start,pt_end])])

a=get_quadrangle_from_random4_points(pts)
# ---------- end ghpython_script_2 ----------

# ---- group: 太阳能板接收面
brep_edges = BrepEdges(Brep=surface_2)  # -> Naked, Interior, NonManifold
join_curves = JoinCurves(Curves=brep_edges.Naked, Preserve=False)

# ---- group: 两点设置入射反射线
unit_z_3 = UnitZ(Factor=1)
end_points_11 = EndPoints(Curve=entwine)  # -> Start, End
number_slider_5 = Slider(1000, range=0..1000)
rotate_7 = Rotate(Vector=unit_z_3, Axis=yz_plane_6, Angle=expr("90-x", degrees(list_item_2)))

# ---- group: 两点设置入射反射线 / 入射线
line_sdl_14 = LineSDL(Start=[end_points_11.Start, end_points_11.End], Direction=rotate_7, Length=number_slider_5)

# ----
flip_matrix = FlipMatrix(Data=line_sdl_14)
list_item_4 = ListItem(List=flip_matrix, Index=0, Wrap=True)  # -> flatten(Item)
list_item_5 = ListItem(List=list_item_4, Index=0, Wrap=True)  # -> Item1, Item, Item1_2

# ---- group: 等效距离计算
pull_point = PullPoint(Point=point_15, Geometry=graft(list_item_5.Item1), ClosestOnly=True)  # -> ClosestPoint, flatten(Distance)
sort_list_3 = SortList(Keys=pull_point.Distance, ValuesValuesA=pull_point.Distance)  # -> reverse(Keys), ValuesValuesA
list_item_6 = ListItem(List=sort_list_3.Keys, Index=0, Wrap=True)
multiplication_3 = Multiplication(A=反射板长度, B=list_item_6)
镜面2等效面积 = Panel(multiplication_3)

pull_point_2 = PullPoint(Point=point_13, Geometry=graft(list_item_5.Item1_2), ClosestOnly=True)  # -> ClosestPoint, flatten(Distance)
sort_list_4 = SortList(Keys=pull_point_2.Distance, ValuesValuesA=pull_point_2.Distance)  # -> reverse(Keys), ValuesValuesA
list_item_7 = ListItem(List=sort_list_4.Keys, Index=0, Wrap=True)
multiplication_4 = Multiplication(A=反射板长度, B=list_item_7)
镜面1等效面积 = Panel(multiplication_4)

# ----
addition = Addition(A=镜面1等效面积, B=镜面2等效面积)
one_over_x = OneOverX(Value=addition)
wlc_等效面积 = Number(one_over_x)

# ---- group: 两点设置入射反射线 / 反射线
rotate_3d_3 = Rotate3D(
    Geometry=graft(line_sdl_14),
    Angle=degrees(180),
    Center=graft([end_points_11.Start, end_points_11.End]),
    Axis=graft(line_sdl_13))  # -> Geometry, Transform

# ----
move_8 = Move(Geometry=line_sdl_14, Motion=expr("-x/2", reverse))  # -> Geometry, Transform
move_9 = Move(Geometry=rotate_3d_3.Geometry, Motion=expr("-x/2", reverse))  # -> Geometry, Transform

# ---- group: 两点设置入射反射线 (continued)
panel_3 = Panel(line_sdl_14)
custom_preview_6 = CustomPreview(Geometry=flatten(move_8.Geometry), Material=ColourSwatch(SwatchColor=RGB(0, 60, 255)))
custom_preview_7 = CustomPreview(Geometry=move_9.Geometry, Material=ColourSwatch(SwatchColor=RGB(255, 85, 0)))

# ---- group: 入射角越小越好
angle = Angle(VectorA=flatten(line_sdl_14), VectorB=flatten(rotate_3d_3.Geometry))  # -> Angle, Reflex
list_item_8 = ListItem(List=angle.Angle, Index=0, Wrap=True)  # -> Item1, Item
addition_2 = Addition(A=list_item_8.Item1, B=list_item_8.Item)

# ----
panel_4 = Panel(addition_2)

# ---- group: 反射投影框
unflatten_tree = UnflattenTree(Tree=rotate_3d_3.Geometry, Guide=line_sdl_14)

# ----
flip_matrix_2 = FlipMatrix(Data=unflatten_tree)

# ---- group: 反射投影框 (continued)
list_item_9 = ListItem(List=flip_matrix_2, Index=0, Wrap=True)  # -> Item, Item1
line_plane = LinePlane(Line=flatten(list_item_9.Item), Plane=is_planar_2.Plane)  # -> Point, ParamL, ParamP
line_plane_2 = LinePlane(Line=flatten(list_item_9.Item1), Plane=is_planar_2.Plane)  # -> Point, ParamL, ParamP

sort_points = SortPoints(Points=line_plane.Point)  # -> Points, Indices
list_item_10 = ListItem(List=sort_points.Points, Index=0, Wrap=True)  # -> Item, Item1, Item2, Item3
line_7 = Line(StartPoint=list_item_10.Item2, EndPoint=list_item_10.Item3)
line_8 = Line(StartPoint=list_item_10.Item, EndPoint=list_item_10.Item1)
loft = Loft(Curves=[line_8, line_7], Options={Adjust=True, Closed=False, LoftEnds=0, LoftSimp=0, LoftType=0, Rebuild=10, Refit=0.01})

sort_points_2 = SortPoints(Points=line_plane_2.Point)  # -> Points, Indices
list_item_11 = ListItem(List=sort_points_2.Points, Index=0, Wrap=True)  # -> Item, Item1, Item2, Item3
line_9 = Line(StartPoint=list_item_11.Item, EndPoint=list_item_11.Item1)
line_10 = Line(StartPoint=list_item_11.Item2, EndPoint=list_item_11.Item3)
loft_2 = Loft(
    Curves=[line_9, line_10],
    Options={Adjust=True, Closed=False, LoftEnds=0, LoftSimp=0, LoftType=0, Rebuild=10, Refit=0.01})

area = Area(Geometry=loft_2)  # -> Area, Centroid
area_2 = Area(Geometry=loft)  # -> Area, Centroid

# ---- group: 趋近于一个面的算法
area_3 = Area(Geometry=surface)  # -> Area, Centroid
distance = Distance(PointA=area.Centroid, PointB=area_3.Centroid)
distance_2 = Distance(PointA=area_2.Centroid, PointB=area_3.Centroid)
addition_3 = Addition(A=distance_2, B=distance)
panel_5 = Panel(distance_2)

# ----
wlc_投影相对位置1 = Number(distance_2)
wlc_投影相对位置1_2 = Number(distance)

# ---- group: wallacei遗传算法
entwine_2 = Entwine(Branch00=pipe_4, Branch01=extrude, Branch02=[loft, loft_2], FlattenInputs=True)
wallacei_x = WallaceiX(
    Genes=[wlc_杆1, wlc_杆2],
    Objectives=[wlc_投影相对位置1, wlc_投影相对位置1_2, wlc_等效面积],
    Phenotype=entwine_2,
    allFitness="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",
    allFrontIdx="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",
    allGenomes="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",
    curFrontIdx="39|0;39|1;39|2;39|3;39|4;39|5;39|6;39|7;39|8;39|9;39|10;39|11;39|12;39|13;39|14;39|15;39|16;39|17;39|18;39|19",
    curFrontIdxSave="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",
    popGen="20,40",
    total="20172",
    wlcDone=True)  # -> WallaceiGenomes, FitnessValues, Data, Phenotypes
number_slider_6 = Slider(2, range=0..10)
distribute_to_grid = DistributeToGrid(
    FitnessValues=wallacei_x.FitnessValues,
    WallaceiPhenotypes=wallacei_x.Phenotypes,
    SizeOfTheGridInTheXDirection=number_slider_6,
    SizeOfTheGridInTheYDirection=number_slider_6,
    OutputOptions=0)  # -> DistributedFitnessValues, DistributedData, DistributedGeometries, DistributedMeshes, DistributedNumbers, GridLocations

# ----
division = Division(A=addition, B=addition_3)
panel_6 = Panel(division)

# ---- group: 染色
custom_preview_8 = CustomPreview(Geometry=[move.Geometry, line_sdl_9], Material=ColourSwatch(SwatchColor=RGB(0, 0, 0)))
custom_preview_9 = CustomPreview(Geometry=[line_3, line_4, pipe_4, pipe_3], Material=ColourSwatch(SwatchColor=RGB(0, 71, 201)))
custom_preview_10 = CustomPreview(Geometry=[line_sdl_12, line_sdl_5, move_5.Geometry], Material=ColourSwatch(SwatchColor=RGB(0, 242, 255)))

# ----
brep_edges_2 = BrepEdges(Brep=loft)  # -> Naked, Interior, NonManifold

# ---- group: 投影框
join_curves_2 = JoinCurves(Curves=brep_edges_2.Naked, Preserve=False)

# ---- group: 有效投影框
region_intersection = RegionIntersection(CurvesA=join_curves, CurvesB=join_curves_2)

# ----
area_4 = Area(Geometry=join_curves_2)  # -> Area, Centroid
area_5 = Area(Geometry=region_intersection)  # -> Area, Centroid
division_2 = Division(A=area_5.Area, B=area_4.Area)

ghpython_script_3 = GhPythonScript(input=division_2)  # -> out, flatten(a)
# ---------- ghpython_script_3: Python ----------
__author__ = "13370"
__version__ = "2023.11.16"

import rhinoscriptsyntax as rs


if input:
    a = input
else:
    a = 0
# ---------- end ghpython_script_3 ----------
gh_cpython_2 = GH_CPython(input=division_2)  # -> a; inputs input: list
#   port input: [required] - [type = int] - [default = None] Descripe your input here * bullet point. * bullet point
#   port a: indicate your output description here. refers to a new line.
# ---------- gh_cpython_2: Python ----------
import rhinoscriptsyntax as rs


if input:
    a = input
else:
    a = 0
# ---------- end gh_cpython_2 ----------
multiplication_5 = Multiplication(A=镜面1等效面积, B=ghpython_script_3.a)

brep_edges_3 = BrepEdges(Brep=loft_2)  # -> Naked, Interior, NonManifold

# ---- group: 投影框
join_curves_3 = JoinCurves(Curves=brep_edges_3.Naked, Preserve=False)

# ---- group: 有效投影框
region_intersection_2 = RegionIntersection(CurvesA=join_curves, CurvesB=join_curves_3)

# ----
area_6 = Area(Geometry=join_curves_3)  # -> Area, Centroid
area_7 = Area(Geometry=region_intersection_2)  # -> Area, Centroid
division_3 = Division(A=area_7.Area, B=area_6.Area)

move_10 = Move(Geometry=[join_curves_2, join_curves_3], Motion=expr("-x/2", reverse))  # -> Geometry, Transform

# ---- group: 染色 (continued)
custom_preview_11 = CustomPreview(Geometry=move_10.Geometry, Material=ColourSwatch(SwatchColor=RGB(255, 245, 102)))

# ----
ghpython_script_4 = GhPythonScript(input=division_3)  # -> out, flatten(a); same code as ghpython_script_3
multiplication_6 = Multiplication(A=镜面2等效面积, B=ghpython_script_4.a)
addition_4 = Addition(A=multiplication_5, B=multiplication_6)
division_4 = Division(A=addition_4, B=panel_4)
panel_7 = Panel(division_4)
