# Grasshopper definition raySimulation8.gh (Grasshopper 1.0.7)
# plug-ins: RhinoCodePluginGH

# ---- group: 超参数
横纵比1_0_688 = Point(Point(-0.7496508102, 0.4980105901, 2.236337855))
距光伏板水平距离 = Slider(0.1, range=0..1)
距光伏板垂直距离 = Slider(0.06, range=0..1)

# ---- group: 杆件所需长度 / 杆件2 12个月最优解
genes = GenePool(Decimals=2, Maximum=1, Minimum=0, Value=[0.04, 0.18, 0.35, 0.59, 0.76, 0.82, 0.76, 0.58, 0.35, 0.17, 0.03, 0])

# ---- group: 杆件所需长度 / 杆件1 12个月最优解
genes_2 = GenePool(Decimals=2, Maximum=1, Minimum=0, Value=[0.07, 0.26, 0.43, 0.63, 0.75, 0.79, 0.75, 0.62, 0.43, 0.25, 0.05, 0])

# ---- group: 基点
反射板前沿中心点 = Point(Point(-0.7496508102, 0.4980105901, 2.236337855))

# ----
伸缩杆1长度参数 = Slider(0.78, range=0..1)
伸缩杆2长度参数 = Slider(0.81, range=0..1)

galapagos = Galapagos(gene=[伸缩杆2长度参数, 伸缩杆1长度参数])

panel = Panel("""35
36
37
38
39
40
41
42
43
44
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""")

# ---- group: 杆件1最优解
gene_pool = GenePool(Decimals=2, Maximum=1, Minimum=0, Value=[0, 0.02, 0.04, 0.05, 0.09, 0.1, 0.13, 0.15, 0.16, 0.19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])

# ---- group: 杆件2最优解
gene_pool_2 = GenePool(Decimals=2, Maximum=1, Minimum=0, Value=[0, 0.01, 0.02, 0.03, 0.05, 0.06, 0.08, 0.09, 0.1, 0.12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])

# ----
panel_2 = Panel("""38.157476
47.541607
58.466311
70.146702
78.358181
81.305069
78.020859
69.729472
58.349532
46.912568
37.850895
34.559333""")
月份 = Slider(8, range=1..12)
item = ListItem(List=panel_2, Index=expr("x-1", 月份), Wrap=True)

# ---- group: 超参数
number_slider = Slider(0.19, range=0..1)
反射板长度 = Slider(0.8, range=0..1)
dom = ConstructDomain(DomainStart=number_slider, DomainEnd=Slider(0.24, range=0..1))
S = Script(panelLength=反射板长度, rodBaseLength=number_slider)  # -> out, t, dist; inputs panelLength: Double, rodBaseLength: Double
# ---------- S: IronPython ----------
import math 


dist = rodBaseLength * math.cos(math.pi / 4) #伸缩杆固定端距反射板固定轴垂直距离

t =  dist / panelLength  #杆板交点位置参数
# ---------- end S ----------
反射板宽度 = Slider(1.6, range=0..10)
S_2 = Script(basePt=反射板前沿中心点, length=反射板长度, dist1=距光伏板水平距离, dist2=距光伏板垂直距离, t=S.t, rodLength=dom, dist3=S.dist)  # -> out, rod_fixed_pt, panel_fixed_edge_midPt, r; inputs basePt: Point3d, length: Double, dist1: Double, dist2: Double, t: Double, dist3: Double
# ---------- S_2: C# ----------
// Grasshopper Script Instance
using System;
using System.Collections;
using System.Collections.Generic;
using System.Drawing;

using Rhino;
using Rhino.Geometry;

using Grasshopper;
using Grasshopper.Kernel;
using Grasshopper.Kernel.Data;
using Grasshopper.Kernel.Types;

public class Script_Instance : GH_ScriptInstance
{
  /* 
    Members:
      RhinoDoc RhinoDocument
      GH_Document GrasshopperDocument
      IGH_Component Component
      int Iteration

    Methods (Virtual & overridable):
      Print(string text)
      Print(string format, params object[] args)
      Reflect(object obj)
      Reflect(object obj, string method_name)
  */
  
  private void RunScript(
	Point3d basePt,
	double length,
	double dist1,
	double dist2,
	double t,
	Interval rodLength,
	double dist3,
	out object rod_fixed_pt,
	out object panel_fixed_edge_midPt,
	out object r)
  {
    // Write your logic here
        double rodBaseLength = rodLength.Min; //伸缩杆的基础长度
    var projected_length = Math.Sqrt(Math.Pow(rodBaseLength, 2) - Math.Pow(dist3, 2));

    var panel_fixed_mid_point = new Point3d(basePt.X, basePt.Y - dist1, basePt.Z - dist2);//反射板前沿固定中点
    panel_fixed_edge_midPt = panel_fixed_mid_point;

    var distance = length * t;//距离反射板前沿端点距离
    r = distance;

    if(distance > projected_length)
    {
      var rod_fixed_point =  new Point3d(basePt.X, basePt.Y - (dist1 - (projected_length - distance)), basePt.Z - dist2 - dist3);//得到伸缩杆固定端端点
      rod_fixed_pt = rod_fixed_point;
    }
    else
    {
      var rod_fixed_point = new Point3d(basePt.X, basePt.Y - dist1 - (distance - projected_length), basePt.Z - dist2 - dist3);//得到伸缩杆固定端端点
      rod_fixed_pt = rod_fixed_point;
    }
  }
}
# ---------- end S_2 ----------
S_3 = Script(pt1=S_2.rod_fixed_pt, pt2=S_2.panel_fixed_edge_midPt, r=S_2.r, width=反射板宽度, length=反射板长度, rodLength=dom, t=伸缩杆1长度参数)  # -> out, rod, joint_pt, panel; inputs pt1: Point3d, pt2: Point3d, r: Double, width: Double, length: Double, t: Double
# ---------- S_3: C# ----------
// Grasshopper Script Instance
using System;
using System.Collections;
using System.Collections.Generic;
using System.Drawing;
using System.Linq;
using Rhino;
using Rhino.Geometry;

using Grasshopper;
using Grasshopper.Kernel;
using Grasshopper.Kernel.Data;
using Grasshopper.Kernel.Types;

public class Script_Instance : GH_ScriptInstance
{
  /* 
    Members:
      RhinoDoc RhinoDocument
      GH_Document GrasshopperDocument
      IGH_Component Component
      int Iteration

    Methods (Virtual & overridable):
      Print(string text)
      Print(string format, params object[] args)
      Reflect(object obj)
      Reflect(object obj, string method_name)
  */
  
  private void RunScript(
	Point3d pt1,
	Point3d pt2,
	double r,
	double width,
	double length,
	Interval rodLength,
	double t,
	out object rod,
	out object joint_pt,
	out object panel)
  {
    // Write your logic here
        var r_rod = (rodLength.Max - rodLength.Min) * t + rodLength.Min;//伸缩杆实时长度
    var pt_intersect = GetIntersectPoint(pt1, pt2, r_rod, r);
    var line = new Line(pt1, pt_intersect);//伸缩杆
    rod1_length = line.Length;

    var vec = pt_intersect - pt2;
    vec.Unitize(); //得到反射板单位方向向量
    var rec = GetPanel(pt2, vec, width, length);


    //Output
    rod = line;
    joint_pt = pt_intersect;
    panel = rec;
  }
    double rod1_length;

  public Point3d GetIntersectPoint(Point3d pt1, Point3d pt2, double r1, double r2)
  {
    var c1 = new Circle(Plane.WorldYZ, pt1, r1);
    var c2 = new Circle(Plane.WorldYZ, pt2, r2);
    Point3d pt_inter1;
    Point3d pt_inter2;
    var result = Rhino.Geometry.Intersect.Intersection.CircleCircle(c1, c2, out pt_inter1, out pt_inter2);

    //排序点,获取所需相交点
    List<Point3d> ptList = new List<Point3d>();
    ptList.Add(pt_inter1);
    ptList.Add(pt_inter2);
    ptList = ptList.OrderBy(pt => pt.Y).ToList();
    var pt_intersect = ptList[0];
    return pt_intersect;
  }

  public Rectangle3d GetPanel(Point3d pt, Vector3d vec, double width, double length)
  {
    var newVec = vec * (length / 2);
    var newPt = pt + newVec;//反射板中心点

    var vec1 = new Vector3d(vec);
    var vec2 = new Vector3d(vec);
    vec.Rotate(Math.PI / 2, new Vector3d(1, 0, 0));

    vec1.Rotate(Math.PI / 2, vec);
    var plane = new Plane(newPt, vec1, vec2);//构造反射板平面

    var wInterval = new Interval(-width / 2, width / 2);
    var lInterval = new Interval(-length / 2, length / 2);
    var rec = new Rectangle3d(plane, wInterval, lInterval);
    return rec;
  }


  //Return a BoundingBox that contains all the geometry you are about to draw.
  public override BoundingBox ClippingBox
  {
    get
    {
      return BoundingBox.Empty;
    }
  }

  //Draw all meshes in this method.
  public override void DrawViewportMeshes(IGH_PreviewArgs args)
  {
  }

  //Draw all wires and points in this method.
  public override void DrawViewportWires(IGH_PreviewArgs args)
  {
    var location = new Point2d(50, RhinoDocument.Views.ActiveView.Bounds.Height - 200);
    args.Display.Draw2dText(
      "Rod1 length: " + Math.Round(rod1_length, 3) + " m",
      System.Drawing.Color.Black,
      location,
      false, 30);
  }
}
# ---------- end S_3 ----------
两伸缩杆固定点间距 = Slider(0.663, range=0..2)
杆板交点位置参数 = Slider(0.38, range=0..1)
dom_2 = ConstructDomain(DomainStart=Slider(0.49, range=0..1), DomainEnd=Slider(0.79, range=0..1))
S_4 = Script(
    rod1_fixed_point=S_2.rod_fixed_pt,
    rodLength=dom_2,
    width=反射板宽度,
    length=反射板长度,
    panel1=S_3.panel,
    dist=两伸缩杆固定点间距,
    t1=杆板交点位置参数,
    t2=伸缩杆2长度参数)  # -> out, panel_edge_mid_pt, rod2_fixed_point, joint_pt, rod, panel2; inputs rod1_fixed_point: Point3d, width: Double, length: Double, panel1: Rectangle3d, dist: Double, t1: Double, t2: Double
# ---------- S_4: C# ----------
// Grasshopper Script Instance
using System;
using System.Collections;
using System.Collections.Generic;
using System.Drawing;
using System.Linq;
using Rhino;
using Rhino.Geometry;

using Grasshopper;
using Grasshopper.Kernel;
using Grasshopper.Kernel.Data;
using Grasshopper.Kernel.Types;

public class Script_Instance : GH_ScriptInstance
{
  /* 
    Members:
      RhinoDoc RhinoDocument
      GH_Document GrasshopperDocument
      IGH_Component Component
      int Iteration

    Methods (Virtual & overridable):
      Print(string text)
      Print(string format, params object[] args)
      Reflect(object obj)
      Reflect(object obj, string method_name)
  */
  
  private void RunScript(
	Point3d rod1_fixed_point,
	Interval rodLength,
	double width,
	double length,
	Rectangle3d panel1,
	double dist,
	double t1,
	double t2,
	out object panel_edge_mid_pt,
	out object rod2_fixed_point,
	out object joint_pt,
	out object rod,
	out object panel2)
  {
    // Write your logic here
        var mid_pt = GetPanelEdgeMidPt(panel1);
    var rod_fixed_point = new Point3d(rod1_fixed_point.X, rod1_fixed_point.Y - dist, rod1_fixed_point.Z);

    //得到铰接点
    var r1 = length * t1;
    var r2 = (rodLength.Max - rodLength.Min) * t2 + rodLength.Min;
    var pt_intersect = GetIntersectPoint(mid_pt, rod_fixed_point, r1, r2);

    //得到第二个伸缩杆
    var line = new Line(pt_intersect, rod_fixed_point);
    rod2_length = line.Length;

    //创建第二个反射面
    var vec = pt_intersect - mid_pt;
    vec.Unitize();
    var rec = GetPanel(mid_pt, vec, width, length);



    //Output
    panel_edge_mid_pt = mid_pt;
    rod2_fixed_point = rod_fixed_point;
    joint_pt = pt_intersect;
    rod = line;
    panel2 = rec;
  }
    double rod2_length;
  public Point3d GetPanelEdgeMidPt(Rectangle3d rec)
  {
    //获得第二块反射板边缘中点
    var dis = 0.03;//dis为两反射板之间的间距
    var pt1 = rec.Corner(2);
    var pt2 = rec.Corner(3);
    var mid = new Point3d((pt1.X + pt2.X) / 2, pt1.Y - dis, pt1.Z);
    return mid;
  }

  public Point3d GetIntersectPoint(Point3d pt1, Point3d pt2, double r1, double r2)
  {
    var c1 = new Circle(Plane.WorldYZ, pt1, r1);
    var c2 = new Circle(Plane.WorldYZ, pt2, r2);
    Point3d pt_inter1;
    Point3d pt_inter2;
    var result = Rhino.Geometry.Intersect.Intersection.CircleCircle(c1, c2, out pt_inter1, out pt_inter2);

    //排序点,获取所需相交点
    List<Point3d> ptList = new List<Point3d>();
    ptList.Add(pt_inter1);
    ptList.Add(pt_inter2);
    ptList = ptList.OrderBy(pt => pt.Y).ToList();
    var pt_intersect = ptList[0];
    return pt_intersect;
  }

  public Rectangle3d GetPanel(Point3d pt, Vector3d vec, double width, double length)
  {
    var newVec = vec * (length / 2);
    var newPt = pt + newVec;//反射板中心点

    var vec1 = new Vector3d(vec);
    var vec2 = new Vector3d(vec);
    vec.Rotate(Math.PI / 2, new Vector3d(1, 0, 0));

    vec1.Rotate(Math.PI / 2, vec);
    var plane = new Plane(newPt, vec1, vec2);//构造反射板平面

    var wInterval = new Interval(-width / 2, width / 2);
    var lInterval = new Interval(-length / 2, length / 2);
    var rec = new Rectangle3d(plane, wInterval, lInterval);
    return rec;
  }

  //Return a BoundingBox that contains all the geometry you are about to draw.
  public override BoundingBox ClippingBox
  {
    get
    {
      return BoundingBox.Empty;
    }
  }

  //Draw all meshes in this method.
  public override void DrawViewportMeshes(IGH_PreviewArgs args)
  {
  }

  //Draw all wires and points in this method.
  public override void DrawViewportWires(IGH_PreviewArgs args)
  {
    var location = new Point2d(50, RhinoDocument.Views.ActiveView.Bounds.Height - 150);
    args.Display.Draw2dText(
      "Rod2 length: " + Math.Round(rod2_length, 3) + " m",
      System.Drawing.Color.Black,
      location,
      false, 30);
  }
}
# ---------- end S_4 ----------
merge = Merge(Data1=S_3.panel, Data2=S_4.panel2)
srf = Surface(merge)
S_5 = Script(panels=merge, angle=item)  # -> out, rays, reflected_rays, parameters; inputs panels: list of Rectangle3d, angle: Double
# ---------- S_5: C# ----------
// Grasshopper Script Instance
using System;
using System.Collections;
using System.Collections.Generic;
using System.Drawing;
using System.Linq;
using Rhino;
using Rhino.Geometry;

using Grasshopper;
using Grasshopper.Kernel;
using Grasshopper.Kernel.Data;
using Grasshopper.Kernel.Types;

public class Script_Instance : GH_ScriptInstance
{
  /* 
    Members:
      RhinoDoc RhinoDocument
      GH_Document GrasshopperDocument
      IGH_Component Component
      int Iteration

    Methods (Virtual & overridable):
      Print(string text)
      Print(string format, params object[] args)
      Reflect(object obj)
      Reflect(object obj, string method_name)
  */
  
  private void RunScript(
	IEnumerable<Rectangle3d> panels,
	double angle,
	out object rays,
	out object reflected_rays,
	out object parameters)
  {
    // Write your logic here
        double[] param =new double[2];//太阳光入射角与反射光入射角余弦积
    var rays1 = new List<Line>();//反射光线
    var rays2 = new List<Line>();//入射光线

    var panelList = panels.ToList();

    for(int i = 0;i < panelList.Count;i++)
    {
      Vector3d inVec;
      Vector3d outVec;
      GenerateInvecOutvec(angle, panelList[i], out inVec, out outVec);

      inVec.Reverse();
      var alpha1 = Vector3d.VectorAngle(inVec, outVec, Plane.WorldYZ) / 2;//太阳光入射角
      var alpha2 = ComputeAngle(outVec);//反射光线入射角
      param[i] = Math.Cos(alpha1) * Math.Cos(alpha2);


      var lines1 = GenerateRay(panelList[i], outVec);//生成反射光线
      var lines2 = GenerateRay(panelList[i], inVec);//生成入射光线
      rays1.AddRange(lines1);
      rays2.AddRange(lines2);
    }

    //Output
    reflected_rays = rays1;
    rays = rays2;
    parameters = param;
  }
    public void GenerateInvecOutvec(double angle, Rectangle3d rec, out Vector3d inVec, out Vector3d outVec)
  {
    //根据给定太阳高度角，生成入射向量，反射向量
    inVec = new Vector3d(0, 1, 0);
    inVec.Rotate(-Math.PI * angle / 180, new Vector3d(1, 0, 0));//入射向量
    var norm = rec.Plane.Normal;
    if(norm * inVec > 0)
    {
      norm.Reverse();
    }
    norm.Unitize();
    outVec = inVec - 2 * (inVec * norm) * norm;//反射向量

  }
  public List<Line> GenerateRay(Rectangle3d rec, Vector3d vec)
  {
    //生成指定向量方向的射线

    var rays = new List<Line>();
    for(int i = 0; i < 4;i++)
    {
      var pt = rec.Corner(i);
      var line = new Line(pt, vec, 10);//10为设定射线长度
      rays.Add(line);
    }
    return rays;

  }
  public double ComputeAngle(Vector3d outVec)
  {
    //计算反射光线与光伏板的入射角
    var norm = new Vector3d(0, -1, 0);
    var outoutVec = outVec - 2 * (outVec * norm) * norm;//光伏板上的反射向量
    outVec.Reverse();
    return Vector3d.VectorAngle(outVec, outoutVec, Plane.WorldYZ) / 2;
  }
}
# ---------- end S_5 ----------
光伏板 = Surface(<surface referenced from the Rhino model>)
rec = Rectangle(光伏板)
S_6 = Script(panels=merge, rays=S_5.reflected_rays, parameters=S_5.parameters, border=rec)  # -> out, regions, energySum; inputs panels: list of Rectangle3d, rays: list of Line, parameters: list of Double, border: Rectangle3d
# ---------- S_6: C# ----------
// Grasshopper Script Instance
using System;
using System.Collections;
using System.Collections.Generic;
using System.Drawing;
using System.Linq;
using Rhino;
using Rhino.Geometry;

using Grasshopper;
using Grasshopper.Kernel;
using Grasshopper.Kernel.Data;
using Grasshopper.Kernel.Types;

public class Script_Instance : GH_ScriptInstance
{
  /* 
    Members:
      RhinoDoc RhinoDocument
      GH_Document GrasshopperDocument
      IGH_Component Component
      int Iteration

    Methods (Virtual & overridable):
      Print(string text)
      Print(string format, params object[] args)
      Reflect(object obj)
      Reflect(object obj, string method_name)
  */
  
  private void RunScript(
	IEnumerable<Rectangle3d> panels,
	IEnumerable<Line> rays,
	IEnumerable<double> parameters,
	Rectangle3d border,
	out object regions,
	out object energySum)
  {
    // Write your logic here
        var plane = border.Plane;//光伏板所在平面
    var crvs = new List<Curve>();
    var areaProjected = new List<double>();//投影总面积

    var rec1 = GetRegionOnPlane(plane, rays.Take(4).ToList());
    var rec2 = GetRegionOnPlane(plane, rays.Skip(4).ToList());

    areaProjected.Add(rec1.Area);
    areaProjected.Add(rec2.Area);

    crvs.Add(rec1.ToNurbsCurve());
    crvs.Add(rec2.ToNurbsCurve());//获得初始区域

    for(int i = 0;i < crvs.Count;i++)
    {
      if(IsRegionValid(crvs[i], border, plane))
        continue;
      else
      {
        Curve curve;
        CreateCommonRegion(crvs[i], border, out curve);
        crvs[i] = curve;
      }
    }

    var arguments = parameters.ToList();
    energy = ComputeEnergy(arguments, crvs, areaProjected);

    //Output
    regions = crvs;
    energySum = energy;
  }
    double energy;
  public Rectangle3d GetRegionOnPlane(Plane plane, List<Line> lines)
  {
    //创建反射区域
    var pts = new List<Point3d>();
    foreach(var line in lines)
    {
      double t;
      Rhino.Geometry.Intersect.Intersection.LinePlane(line, plane, out t);
      pts.Add(line.PointAt(t));
    }
    return new Rectangle3d(plane, pts[0], pts[2]);

  }

  public bool IsRegionValid(Curve crv, Rectangle3d border, Plane plane)
  {
    //检查投影区域是否完全在光伏板内部
    var result = Curve.PlanarClosedCurveRelationship(crv, border.ToNurbsCurve(), plane, 0.01);
    if(result == RegionContainment.AInsideB) return true;
    return false;
  }

  public void CreateCommonRegion(Curve crv, Rectangle3d border, out Curve curve)
  {
    //投影区域与边框相交，返回相交区域
    var crvs = new List<Curve>();
    crvs.Add(crv);
    crvs.Add(border.ToNurbsCurve());
    curve = Curve.CreateBooleanIntersection(crv, border.ToNurbsCurve(), 0.01)[0];

  }

  public double ComputeEnergy(List<double> param, List<Curve> crvs, List<double> areas)
  {
    //计算光伏板得到的能量 energy = cos(alpha1) * cos(alpha2) * (S接受 / S投影)
    double sum = 0;
    for(int i = 0;i < crvs.Count;i++)
    {
      var area = AreaMassProperties.Compute(crvs[i]).Area;
      sum += param[i] * area / areas[i];
    }
    return sum;
  }


  //Return a BoundingBox that contains all the geometry you are about to draw.
  public override BoundingBox ClippingBox
  {
    get
    {
      return BoundingBox.Empty;
    }
  }

  //Draw all meshes in this method.
  public override void DrawViewportMeshes(IGH_PreviewArgs args)
  {
  }

  //Draw all wires and points in this method.
  public override void DrawViewportWires(IGH_PreviewArgs args)
  {
    Point2d location = new Point2d(50, RhinoDocument.Views.ActiveView.Bounds.Height - 250);
    args.Display.Draw2dText(
      "Energy: " + Math.Round(energy, 5) + " \u03A6",
      System.Drawing.Color.Black,
      location,
      false, 30);
  }
}
# ---------- end S_6 ----------

# ----
杆1长度区间 = Domain(dom)
杆2长度区间 = Domain(dom_2)
entwine = Entwine(Branch00=gene_pool, Branch01=gene_pool_2, FlattenInputs=True)
merge_2 = Merge(Data1=杆1长度区间, Data2=杆2长度区间)  # -> graft(Result)
S_7 = Script(values=entwine, domain=merge_2)  # -> out, simplify(mappedLength); inputs values: list of Double
# ---------- S_7: Python ----------
min_value = domain.Min
max_value = domain.Max
mappedLength = [min_value + (max_value - min_value) * value for value in values]
# ---------- end S_7 ----------

距中轴距离 = Slider(0.6, range=0..1)
line = Line(S_4.rod)
S_8 = Script(rod=line, dist=距中轴距离)  # -> out, rods; inputs rod: Line, dist: Double
# ---------- S_8: C# ----------
// Grasshopper Script Instance
using System;
using System.Collections;
using System.Collections.Generic;
using System.Drawing;

using Rhino;
using Rhino.Geometry;

using Grasshopper;
using Grasshopper.Kernel;
using Grasshopper.Kernel.Data;
using Grasshopper.Kernel.Types;

public class Script_Instance : GH_ScriptInstance
{
  /* 
    Members:
      RhinoDoc RhinoDocument
      GH_Document GrasshopperDocument
      IGH_Component Component
      int Iteration

    Methods (Virtual & overridable):
      Print(string text)
      Print(string format, params object[] args)
      Reflect(object obj)
      Reflect(object obj, string method_name)
  */
  
  private void RunScript(Line rod, double dist, out object rods)
  {
    // Write your logic here
        var result = OffsetRod(rod, dist);


    rods = result;
  }
    public List<Line> OffsetRod(Line rod, double d)
  {
    //向两侧偏移杆件
    var lines = new List<Line>();
    var rod1 = new Line(rod.From, rod.To);
    var rod2 = new Line(rod.From, rod.To);

    var trans1 = Transform.Translation(new Vector3d(d, 0, 0));
    var trans2 = Transform.Translation(new Vector3d(-d, 0, 0));
    rod1.Transform(trans1);
    rod2.Transform(trans2);
    lines.Add(rod1);
    lines.Add(rod2);


    return lines;
  }
}
# ---------- end S_8 ----------

# ----
# 35°-81°对应极值
panel_3 = Panel(S_7.mappedLength)

# ----
# 全年逐小时太阳高度角数据
_1月 = Panel("""9.13991
18.952412
27.032612
32.626217
34.959175
33.621341
28.855132
21.378006
11.976537
1.275801
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""")
_2月 = Panel("""11.030926
21.65468
30.724382
37.399123
40.677854
39.881799
35.18986
27.482288
17.733504
6.680148
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""")
_3月 = Panel("""17.065648
28.506164
38.586591
46.287923
50.16361
49.095066
43.425547
34.568234
23.823014
12.013286
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""")
_4月 = Panel("""25.805047
37.997098
49.179365
58.115486
62.424543
60.007698
52.146615
41.460506
29.495554
16.973256
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""")
_5月 = Panel("""32.723915
45.353022
57.474393
67.93085
73.039599
68.507029
58.253923
46.199601
33.596765
20.894367
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""")
_6月 = Panel("""35.738779
48.445272
61.056023
72.896033
80.020802
73.824433
62.137557
49.557573
36.85262
24.278335
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""")
_7月 = Panel("""34.92533
47.606242
60.274885
72.42309
80.907925
75.570588
63.852281
51.248827
38.543551
25.979592
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""")
_8月 = Panel("""32.209256
44.908262
57.356013
68.73657
75.810117
72.206276
61.776988
49.56751
36.905504
24.206892
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""")
_9月 = Panel("""28.735286
41.094754
52.589052
61.931751
66.28462
63.065415
54.284059
43.012583
30.735244
18.078019
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""")
_10月 = Panel("""12.111271
24.325121
35.731293
45.584419
52.552872
54.82974
51.559803
43.921937
33.69718
22.091977
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""")
_11月 = Panel("""6.98359
18.372441
28.577985
36.86611
42.196951
43.524604
40.5222
33.887371
24.733909
13.989905
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""")
_12月 = Panel("""12.487233
22.06709
29.747485
34.713599
36.19882
33.923431
28.305712
20.156123
10.260389
0
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""")
merge_3 = Merge(
    Data1=_1月,
    Data2=_2月,
    Data3=_3月,
    Data4=_4月,
    Data5=_5月,
    Data6=_6月,
    Data7=_7月,
    Data8=_8月,
    Data9=_9月,
    Data10=_10月,
    Data11=_11月,
    Data12=_12月)
list_length = ListLength(List=merge_3)

# ---- group: 每天十个小时
全年逐小时太阳高度角数据 = Panel(merge_3)

# ---- group: 杆件所需长度
杆1长度区间_2 = Domain(dom)
杆2长度区间_2 = Domain(dom_2)
entwine_2 = Entwine(Branch00=genes_2, Branch01=genes, FlattenInputs=True)
merge_4 = Merge(Data1=杆1长度区间_2, Data2=杆2长度区间_2)  # -> graft(Result)

# ----
S_9 = Script(values=entwine_2, domain=merge_4)  # -> out, simplify(mappedLength); inputs values: list of Double; same code as S_7

# ---- group: 杆件所需长度 (continued)
bnd = Bounds(Numbers=S_9.mappedLength)  # -> simplify(Domain)
panel_4 = Panel(S_9.mappedLength)
