# Grasshopper definition raySim小比例.gh (Grasshopper 1.0.7)

第一杆初始倾斜角度 = Slider(45, range=0..100)
number_slider = Slider(0.19, range=0..1)

横纵比1_0_688 = Point(Point(-0.7496508102, 0.4980105901, 2.236337855))
距光伏板垂直距离 = Slider(0.06, range=0..1)
距光伏板水平距离 = Slider(0.1, range=0..1)

伸缩杆固定端距反射板固定轴垂直距离 = Slider(0.134, range=0..0.4)  # disabled
杆板交点位置参数 = Slider(0.169, range=0..1)  # disabled
反射板前沿中心点 = Point(Point(-0.7496508102, 0.4980105901, 2.236337855))
反射板长度 = Slider(0.4, range=0..1)

# ---- group: 计算第一杆铰点位置参数
radians = Radians(Degrees=第一杆初始倾斜角度)
sine = Sine(Value=radians)
cosine = Cosine(Value=radians)
multiplication = Multiplication(A=number_slider, B=sine)
multiplication_2 = Multiplication(A=number_slider, B=cosine)
division = Division(A=multiplication, B=反射板长度)

# ----
dom = ConstructDomain(DomainStart=number_slider, DomainEnd=Slider(0.24, range=0..1))
c_script = CSharpScript(
    basePt=反射板前沿中心点,
    length=反射板长度,
    dist1=距光伏板水平距离,
    dist2=距光伏板垂直距离,
    t=[division, 杆板交点位置参数],
    rodLength=dom,
    dist3=[multiplication_2, 伸缩杆固定端距反射板固定轴垂直距离])  # -> rod_fixed_pt, panel_fixed_edge_midPt, r; inputs basePt: Point3d, length: Double, dist1: Double, dist2: Double, t: Double, dist3: Double
# ---------- c_script: C# ----------
    double rodBaseLength = rodLength.Min; //伸缩杆的基础长度
    var projected_length = Math.Sqrt(Math.Pow(rodBaseLength, 2) - Math.Pow(dist3, 2));

    var panel_fixed_mid_point = new Point3d(basePt.X, basePt.Y - dist1, basePt.Z - dist2);//反射板前沿固定中点
    panel_fixed_edge_midPt = panel_fixed_mid_point;

    var distance = length * t;//距离反射板前沿端点距离
    r = distance;

    if(distance > projected_length)
    {
      var rod_fixed_point =  new Point3d(basePt.X, basePt.Y - (dist1 - (projected_length - distance)), basePt.Z - dist2 - dist3);//得到伸缩杆固定端端点
      rod_fixed_pt = rod_fixed_point;
    }
    else
    {
      var rod_fixed_point = new Point3d(basePt.X, basePt.Y - dist1 - (distance - projected_length), basePt.Z - dist2 - dist3);//得到伸缩杆固定端端点
      rod_fixed_pt = rod_fixed_point;
    }
# ---------- end c_script ----------
反射板宽度 = Slider(0.75, range=0..10)
panel = Panel("0.79 0.25")

# ---- group: 杆件1 12个月最优解
gene_pool = GenePool(Decimals=2, Maximum=1, Minimum=0, Value=[0.07, 0.26, 0.43, 0.63, 0.75, 0.79, 0.75, 0.62, 0.43, 0.25, 0.05, 0])

# ----
number_slider_2 = Slider(0.29, range=0..1)

伸缩杆1长度参数 = Slider(0, range=0..1)
伸缩杆2长度参数 = Slider(0, range=0..1)

c_script_2 = CSharpScript(
    pt1=c_script.rod_fixed_pt,
    pt2=c_script.panel_fixed_edge_midPt,
    r=c_script.r,
    width=反射板宽度,
    length=反射板长度,
    rodLength=dom,
    t=伸缩杆1长度参数)  # -> out, rod, joint_pt, panel; inputs pt1: Point3d, pt2: Point3d, r: Double, width: Double, length: Double, t: Double
# ---------- c_script_2: C# usings ----------
using System.Linq;
# ---------- c_script_2: C# ----------
    var r_rod = (rodLength.Max - rodLength.Min) * t + rodLength.Min;//伸缩杆实时长度
    var pt_intersect = GetIntersectPoint(pt1, pt2, r_rod, r);
    var line = new Line(pt1, pt_intersect);//伸缩杆
    rod1_length = line.Length;

    var vec = pt_intersect - pt2;
    vec.Unitize(); //得到反射板单位方向向量
    var rec = GetPanel(pt2, vec, width, length);


    //Output
    rod = line;
    joint_pt = pt_intersect;
    panel = rec;
# ---------- c_script_2: C# additional code ----------
  double rod1_length;

  public Point3d GetIntersectPoint(Point3d pt1, Point3d pt2, double r1, double r2)
  {
    var c1 = new Circle(Plane.WorldYZ, pt1, r1);
    var c2 = new Circle(Plane.WorldYZ, pt2, r2);
    Point3d pt_inter1;
    Point3d pt_inter2;
    var result = Rhino.Geometry.Intersect.Intersection.CircleCircle(c1, c2, out pt_inter1, out pt_inter2);

    //排序点,获取所需相交点
    List<Point3d> ptList = new List<Point3d>();
    ptList.Add(pt_inter1);
    ptList.Add(pt_inter2);
    ptList = ptList.OrderBy(pt => pt.Y).ToList();
    var pt_intersect = ptList[0];
    return pt_intersect;
  }

  public Rectangle3d GetPanel(Point3d pt, Vector3d vec, double width, double length)
  {
    var newVec = vec * (length / 2);
    var newPt = pt + newVec;//反射板中心点

    var vec1 = new Vector3d(vec);
    var vec2 = new Vector3d(vec);
    vec.Rotate(Math.PI / 2, new Vector3d(1, 0, 0));

    vec1.Rotate(Math.PI / 2, vec);
    var plane = new Plane(newPt, vec1, vec2);//构造反射板平面

    var wInterval = new Interval(-width / 2, width / 2);
    var lInterval = new Interval(-length / 2, length / 2);
    var rec = new Rectangle3d(plane, wInterval, lInterval);
    return rec;
  }


  //Return a BoundingBox that contains all the geometry you are about to draw.
  public override BoundingBox ClippingBox
  {
    get
    {
      return BoundingBox.Empty;
    }
  }

  //Draw all meshes in this method.
  public override void DrawViewportMeshes(IGH_PreviewArgs args)
  {
  }

  //Draw all wires and points in this method.
  public override void DrawViewportWires(IGH_PreviewArgs args)
  {
    var location = new Point2d(50, RhinoDocument.Views.ActiveView.Bounds.Height - 600);
    args.Display.Draw2dText(
      "Rod1_length: " + Math.Round(rod1_length, 3) + " m",
      System.Drawing.Color.Black,
      location,
      false, 20);
  }
# ---------- end c_script_2 ----------
两伸缩杆固定点间距 = Slider(0.326, range=0..2)
number_slider_3 = Slider(0.44, range=0..1)
杆板交点位置参数_2 = Slider(0.38, range=0..1)

# ---- group: 杆件2 12个月最优解
gene_pool_2 = GenePool(Decimals=2, Maximum=1, Minimum=0, Value=[0.04, 0.18, 0.35, 0.59, 0.76, 0.82, 0.76, 0.58, 0.35, 0.17, 0.03, 0])

# ----
dom_2 = ConstructDomain(DomainStart=number_slider_2, DomainEnd=number_slider_3)
月份 = Slider(6, range=1..12)
c_script_3 = CSharpScript(
    rod1_fixed_point=c_script.rod_fixed_pt,
    rodLength=dom_2,
    width=反射板宽度,
    length=反射板长度,
    panel1=c_script_2.panel,
    dist=两伸缩杆固定点间距,
    t1=杆板交点位置参数_2,
    t2=伸缩杆2长度参数)  # -> out, panel_edge_mid_pt, rod2_fixed_point, joint_pt, rod, panel2; inputs rod1_fixed_point: Point3d, width: Double, length: Double, panel1: Rectangle3d, dist: Double, t1: Double, t2: Double
# ---------- c_script_3: C# ----------
    var mid_pt = GetPanelEdgeMidPt(panel1);
    var rod_fixed_point = new Point3d(rod1_fixed_point.X, rod1_fixed_point.Y - dist, rod1_fixed_point.Z);

    //得到铰接点
    var r1 = length * t1;
    var r2 = (rodLength.Max - rodLength.Min) * t2 + rodLength.Min;
    var pt_intersect = GetIntersectPoint(mid_pt, rod_fixed_point, r1, r2);

    //得到第二个伸缩杆
    var line = new Line(pt_intersect, rod_fixed_point);
    rod2_length = line.Length;

    //创建第二个反射面
    var vec = pt_intersect - mid_pt;
    vec.Unitize();
    var rec = GetPanel(mid_pt, vec, width, length);



    //Output
    panel_edge_mid_pt = mid_pt;
    rod2_fixed_point = rod_fixed_point;
    joint_pt = pt_intersect;
    rod = line;
    panel2 = rec;
# ---------- c_script_3: C# additional code ----------
  double rod2_length;
  public Point3d GetPanelEdgeMidPt(Rectangle3d rec)
  {
    //获得第二块反射板边缘中点
    var dis = 0.03;//dis为两反射板之间的间距
    var pt1 = rec.Corner(2);
    var pt2 = rec.Corner(3);
    var mid = new Point3d((pt1.X + pt2.X) / 2, pt1.Y - dis, pt1.Z);
    return mid;
  }

  public Point3d GetIntersectPoint(Point3d pt1, Point3d pt2, double r1, double r2)
  {
    var c1 = new Circle(Plane.WorldYZ, pt1, r1);
    var c2 = new Circle(Plane.WorldYZ, pt2, r2);
    Point3d pt_inter1;
    Point3d pt_inter2;
    var result = Rhino.Geometry.Intersect.Intersection.CircleCircle(c1, c2, out pt_inter1, out pt_inter2);

    //排序点,获取所需相交点
    List<Point3d> ptList = new List<Point3d>();
    ptList.Add(pt_inter1);
    ptList.Add(pt_inter2);
    ptList = ptList.OrderBy(pt => pt.Y).ToList();
    var pt_intersect = ptList[0];
    return pt_intersect;
  }

  public Rectangle3d GetPanel(Point3d pt, Vector3d vec, double width, double length)
  {
    var newVec = vec * (length / 2);
    var newPt = pt + newVec;//反射板中心点

    var vec1 = new Vector3d(vec);
    var vec2 = new Vector3d(vec);
    vec.Rotate(Math.PI / 2, new Vector3d(1, 0, 0));

    vec1.Rotate(Math.PI / 2, vec);
    var plane = new Plane(newPt, vec1, vec2);//构造反射板平面

    var wInterval = new Interval(-width / 2, width / 2);
    var lInterval = new Interval(-length / 2, length / 2);
    var rec = new Rectangle3d(plane, wInterval, lInterval);
    return rec;
  }

  //Return a BoundingBox that contains all the geometry you are about to draw.
  public override BoundingBox ClippingBox
  {
    get
    {
      return BoundingBox.Empty;
    }
  }

  //Draw all meshes in this method.
  public override void DrawViewportMeshes(IGH_PreviewArgs args)
  {
  }

  //Draw all wires and points in this method.
  public override void DrawViewportWires(IGH_PreviewArgs args)
  {
    var location = new Point2d(50, RhinoDocument.Views.ActiveView.Bounds.Height - 550);
    args.Display.Draw2dText(
      "Rod2_length: " + Math.Round(rod2_length, 3) + " m",
      System.Drawing.Color.Black,
      location,
      false, 20);
  }
# ---------- end c_script_3 ----------
construct_domain = ConstructDomain(DomainStart=number_slider_2, DomainEnd=number_slider_3)
panel_2 = Panel("""38.157476
47.541607
58.466311
70.146702
78.358181
81.305069
78.020859
69.729472
58.349532
46.912568
37.850895
34.559333""")
galapagos = Galapagos(fitness=c_script_5, gene=[伸缩杆2长度参数, 伸缩杆1长度参数])
ghpython_script = GhPythonScript(x=Slider(0.25, range=0..1), Domain=construct_domain)  # -> out, a
# ---------- ghpython_script: Python ----------
__author__ = "13370"
__version__ = "2023.11.26"

import rhinoscriptsyntax as rs

import Rhino.Geometry as rg

def map_value_to_domain(value, domain):
    min_value = domain.Min
    max_value = domain.Max

    mapped_value = min_value + (max_value - min_value) * value
    return mapped_value

# 输入比例因子和domain
value = x
domain = Domain  

# 调用函数获取映射后的值
a = map_value_to_domain(value, domain)
# ---------- end ghpython_script ----------
list_item = ListItem(List=panel_2, Index=expr("x-1", 月份), Wrap=True)
merge = Merge(Data1=c_script_2.panel, Data2=c_script_3.panel2)
太阳高度角 = Slider(39.7, range=0..85)
最优解位置对应杆件长度 = Panel(ghpython_script.a)
srf = Surface(merge)
bounds = Bounds(Numbers=最优解位置对应杆件长度)
c_script_4 = CSharpScript(panels=merge, angle=list_item)  # -> out, rays, reflected_rays, parameters; inputs panels: list of Rectangle3d, angle: Double
# ---------- c_script_4: C# usings ----------
using System.Drawing;
# ---------- c_script_4: C# ----------
    double[] param =new double[2];//太阳光入射角与反射光入射角余弦积
    var rays1 = new List<Line>();//反射光线
    var rays2 = new List<Line>();//入射光线

    for(int i = 0;i < panels.Count;i++)
    {
      Vector3d inVec;
      Vector3d outVec;
      GenerateInvecOutvec(angle, panels[i], out inVec, out outVec);

      inVec.Reverse();
      var alpha1 = Vector3d.VectorAngle(inVec, outVec, Plane.WorldYZ) / 2;//太阳光入射角
      var alpha2 = ComputeAngle(outVec);//反射光线入射角
      param[i] = Math.Cos(alpha1) * Math.Cos(alpha2);


      var lines1 = GenerateRay(panels[i], outVec);//生成反射光线
      var lines2 = GenerateRay(panels[i], inVec);//生成入射光线
      rays1.AddRange(lines1);
      rays2.AddRange(lines2);
    }

    //Output
    reflected_rays = rays1;
    rays = rays2;
    parameters = param;
# ---------- c_script_4: C# additional code ----------
  public void GenerateInvecOutvec(double angle, Rectangle3d rec, out Vector3d inVec, out Vector3d outVec)
  {
    //根据给定太阳高度角，生成入射向量，反射向量
    inVec = new Vector3d(0, 1, 0);
    inVec.Rotate(-Math.PI * angle / 180, new Vector3d(1, 0, 0));//入射向量
    var norm = rec.Plane.Normal;
    if(norm * inVec > 0)
    {
      norm.Reverse();
    }
    norm.Unitize();
    outVec = inVec - 2 * (inVec * norm) * norm;//反射向量

  }
  public List<Line> GenerateRay(Rectangle3d rec, Vector3d vec)
  {
    //生成指定向量方向的射线

    var rays = new List<Line>();
    for(int i = 0; i < 4;i++)
    {
      var pt = rec.Corner(i);
      var line = new Line(pt, vec, 10);//10为设定射线长度
      rays.Add(line);
    }
    return rays;

  }
  public double ComputeAngle(Vector3d outVec)
  {
    //计算反射光线与光伏板的入射角
    var norm = new Vector3d(0, -1, 0);
    var outoutVec = outVec - 2 * (outVec * norm) * norm;//光伏板上的反射向量
    outVec.Reverse();
    return Vector3d.VectorAngle(outVec, outoutVec, Plane.WorldYZ) / 2;
  }
# ---------- end c_script_4 ----------
光伏板 = Surface(<surface referenced from the Rhino model>)
panel_3 = Panel(bounds)
rec = Rectangle(光伏板)
c_script_5 = CSharpScript(panels=merge, rays=c_script_4.reflected_rays, parameters=c_script_4.parameters, border=rec)  # -> out, regions, energySum; inputs panels: list of Rectangle3d, rays: list of Line, parameters: list of Double, border: Rectangle3d
# ---------- c_script_5: C# ----------
    var plane = border.Plane;//光伏板所在平面
    var crvs = new List<Curve>();
    var areaProjected = new List<double>();//投影总面积

    var rec1 = GetRegionOnPlane(plane, rays.Take(4).ToList());
    var rec2 = GetRegionOnPlane(plane, rays.Skip(4).ToList());

    areaProjected.Add(rec1.Area);
    areaProjected.Add(rec2.Area);

    crvs.Add(rec1.ToNurbsCurve());
    crvs.Add(rec2.ToNurbsCurve());//获得初始区域

    for(int i = 0;i < crvs.Count;i++)
    {
      if(IsRegionValid(crvs[i], border, plane))
        continue;
      else
      {
        Curve curve;
        CreateCommonRegion(crvs[i], border, out curve);
        crvs[i] = curve;
      }
    }

    energy = ComputeEnergy(parameters, crvs, areaProjected);

    //Output
    regions = crvs;
    energySum = energy;
# ---------- c_script_5: C# additional code ----------
  double energy;
  public Rectangle3d GetRegionOnPlane(Plane plane, List<Line> lines)
  {
    //创建反射区域
    var pts = new List<Point3d>();
    foreach(var line in lines)
    {
      double t;
      Rhino.Geometry.Intersect.Intersection.LinePlane(line, plane, out t);
      pts.Add(line.PointAt(t));
    }
    return new Rectangle3d(plane, pts[0], pts[2]);

  }

  public bool IsRegionValid(Curve crv, Rectangle3d border, Plane plane)
  {
    //检查投影区域是否完全在光伏板内部
    var result = Curve.PlanarClosedCurveRelationship(crv, border.ToNurbsCurve(), plane, 0.01);
    if(result == RegionContainment.AInsideB) return true;
    return false;
  }

  public void CreateCommonRegion(Curve crv, Rectangle3d border, out Curve curve)
  {
    //投影区域与边框相交，返回相交区域
    var crvs = new List<Curve>();
    crvs.Add(crv);
    crvs.Add(border.ToNurbsCurve());
    curve = Curve.CreateBooleanIntersection(crv, border.ToNurbsCurve(), 0.01)[0];

  }

  public double ComputeEnergy(List<double> param, List<Curve> crvs, List<double> areas)
  {
    //计算光伏板得到的能量 energy = cos(alpha1) * cos(alpha2) * (S接受 / S投影)
    double sum = 0;
    for(int i = 0;i < crvs.Count;i++)
    {
      var area = AreaMassProperties.Compute(crvs[i]).Area;
      sum += param[i] * area / areas[i];
    }
    return sum;
  }


  //Return a BoundingBox that contains all the geometry you are about to draw.
  public override BoundingBox ClippingBox
  {
    get
    {
      return BoundingBox.Empty;
    }
  }

  //Draw all meshes in this method.
  public override void DrawViewportMeshes(IGH_PreviewArgs args)
  {
  }

  //Draw all wires and points in this method.
  public override void DrawViewportWires(IGH_PreviewArgs args)
  {
    Point2d location = new Point2d(50, RhinoDocument.Views.ActiveView.Bounds.Height - 650);
    args.Display.Draw2dText(
      "Energy: " + Math.Round(energy, 5) + " \u03A6",
      System.Drawing.Color.Black,
      location,
      false, 20);
  }
# ---------- end c_script_5 ----------
energy = Panel(c_script_5.energySum)
