# Grasshopper definition sunlightPy.gh (Grasshopper 1.0.7)

# ---- group: 反射板
第一个反射板角度 = Slider(10, range=0..100)
第二个反射板角度 = Slider(11, range=0..100)
pt = Point(Point(0, 0, 0))
vrot = Rotate(Vector=Vector(1, 0, 0), Axis=Vector(0, 1, 0), Angle=expr("-x", degrees(第一个反射板角度)))
addition = Addition(A=第一个反射板角度, B=第二个反射板角度)
line = LineSDL(Start=pt, Direction=vrot, Length=3.5)
vrot_2 = Rotate(Vector=Vector(1, 0, 0), Axis=Vector(0, 1, 0), Angle=expr("-x", degrees(addition)))
end = EndPoints(Curve=line)  # -> Start, End
line_2 = LineSDL(Start=end.End, Direction=vrot_2, Length=4)
反射板 = JoinCurves(Curves=[line, line_2], Preserve=False)

# ---- group: 入射光
入射光角度 = Slider(47, range=0..100)
入射光线步长 = Slider(0.15, range=0..1)
vrot_3 = Rotate(Vector=Vector(-1, 0, 0), Axis=Vector(0, 1, 0), Angle=expr("-x", degrees(入射光角度)))
pt_2 = Point(Point(24.03623752, 0, 17.90230147))
入射光线数量 = Slider(50, range=0..100)
X = UnitX(Factor=入射光线步长)  # -> expr("-x", UnitVector)
line_3 = LineSDL(Start=pt_2, Direction=vrot_3, Length=99)
光线 = LinearArray(Geometry=line_3, Direction=X, Count=入射光线数量)  # -> Geometry, Transform

# ---- group: 支撑
# 二维
number_slider = Slider(0.24, range=0..1)
number_slider_2 = Slider(0.82, range=0..1)
number_slider_3 = Slider(0.31, range=0..1)
number_slider_4 = Slider(0.77, range=0..1)
g1 = Line(Line((0, 0, 0), (3.252158596, 0, 0)))
g2 = Line(Line((3.269192999, 0, -0.006262024228), (6.772601861, 0, -0.006262024228)))
entwine = Entwine(
    Branch00=[line, line_2],
    Branch01=[g1, g2],
    Branch02=[number_slider_3, number_slider],
    Branch03=[number_slider_4, number_slider_2],
    FlattenInputs=True)
bang = ExplodeTree(Data=entwine)  # -> Branch0, Branch1, Branch2, Branch3
x支撑 = GhPythonScript(crv=bang.Branch0, G=bang.Branch1, t1=bang.Branch2, t2=bang.Branch3)  # -> out, a; inputs crv: Curve, G: Line
# ---------- x支撑: Python ----------
import Rhino.Geometry as rg

a=[]
pt1=crv.PointAt(t1)
pt2=crv.PointAt(t2)

#pt1_project=rg.Point3d(pt1.X,0,0)
#pt2_project=rg.Point3d(pt2.X,0,0)

pt1_project=G.PointAt(t1)
pt2_project=G.PointAt(t2)

a.append(rg.Line(pt1,pt2_project))
a.append(rg.Line(pt2,pt1_project))
# ---------- end x支撑 ----------

# ----
反射线 = GhPythonScript(c1=反射板, crvs=光线.Geometry)  # -> out, a; inputs c1: Curve, crvs: list of Curve
# ---------- 反射线: Python ----------
import Rhino.Geometry as rg
import Rhino.RhinoDoc as doc
import math

tol=doc.ActiveDoc.ModelAbsoluteTolerance

def is_two_lines_intersect(crv1,crv2):
    #判断两条线是否相交
    events=rg.Intersect.Intersection.CurveCurve(crv1,crv2,tol,0.0)
    if events:
        return events[0]

inVec=crvs[0].TangentAtStart
outRays=[]
for crv in crvs:
    event=is_two_lines_intersect(c1,crv)
    if event:
        pt=event.PointA
        t=c1.ClosestPoint(pt)[1]
        vec=c1.TangentAt(t)
        vec.Rotate(-math.pi*0.5,rg.Vector3d(0,1,0))#法线向量
        outVec = inVec-2 * (inVec * vec) * vec#反射向量
        outRays.append(rg.Line(pt,outVec,99))


a=outRays
#a=is_two_lines_intersect(c1,crvs).PointA
# ---------- end 反射线 ----------
preview = CustomPreview(Geometry=反射线.a, Material=ColourSwatch(SwatchColor=RGB(102, 90, 9)))

length2 = Slider(1.7, range=0..10)
degree1 = Slider(1, range=-30..70)
degree2 = Slider(7, range=-40..70)
width = Slider(1.5, range=0..10)
length1 = Slider(1.6, range=0..10)
pt_3 = Point(Point(0, 0, 0))
addition_2 = Addition(A=degree1, B=degree2)
反射板_2 = GhPythonScript(P=pt_3, L1=length1, L2=length1, W=width, D1=degree1, D2=addition_2)  # -> out, panel1, panel2; inputs P: Point3d
# ---------- 反射板_2: Python ----------
import Rhino.Geometry as rg
import math


def create_panel(pt,l,w):
    #根据输入点，长度，宽度生成平面反射板
    end_pt=rg.Point3d(pt.X + l,0,pt.Z)
    line=rg.Line(pt,end_pt)
    return rg.Surface.CreateExtrusion(line.ToNurbsCurve(),rg.Vector3d(0,w,0))

def get_surface_corner_point(srf):
    #得到曲面角点
    u=srf.Domain(0).T0
    v=srf.Domain(1).T1
    return srf.PointAt(u,v)


panel1 = create_panel(P,L1,W)

panel1.Rotate(- D1 / 180 * math.pi,rg.Vector3d(0,1,0),P)
panel2_pt=get_surface_corner_point(panel1)

panel2= create_panel(panel2_pt,L2,W)
panel2.Rotate(- D2 / 180 * math.pi,rg.Vector3d(0,1,0),panel2_pt)
# ---------- end 反射板_2 ----------
merge = Merge(Data1=反射板_2.panel1, Data2=反射板_2.panel2)

X_2 = UnitX(Factor=Slider(3.9, range=0..10))

# ---- group: 光伏板
number_slider_5 = Slider(1.6, range=0..10)
rectangle = Rectangle(Plane=PlaneXY(0, 0, 0), XSize=number_slider_5, YSize=Slider(1.2, range=0..10), Radius=0)  # -> Rectangle, Length
rotate = Rotate(Geometry=rectangle.Rectangle, Angle=1.570796327, Plane=PlaneXZ(0, 0, 0))  # -> Geometry, Transform
Z = UnitZ(Factor=Slider(1, range=0..10))
move = Move(Geometry=rotate.Geometry, Motion=Z)  # -> Geometry, Transform
X_3 = UnitX(Factor=Slider(1.5, range=0..5))
move_2 = Move(Geometry=move.Geometry, Motion=expr("-X", X_3))  # -> Geometry, Transform
Z_2 = UnitZ(Factor=number_slider_5)
arrlinear = LinearArray(Geometry=move_2.Geometry, Direction=Z_2, Count=3)  # -> Geometry, Transform
item = ListItem(List=arrlinear.Geometry, Index=0, Wrap=True)  # -> Item, Item1, Item2

# ----
galapagos = Galapagos(fitness=反射区域, gene=[degree1, degree2])
pt_4 = Point([Point(18.63427223, 7.917668399, 0), Point(18.82554494, 7.90698611, 0), Point(18.62468761, 7.776229447, 0), Point(18.96302487, 7.756382903, 0)])
python = GhPythonScript(pts=pt_4)  # -> out, a; inputs pts: list of Point3d
# ---------- python: Python ----------
import Rhino.Geometry as rg


def get_quadrangle_from_random4_points(pts):
    #无序点得到四边形
    pts.sort(key = lambda pt:pt.X) #根据点的X坐标进行初次筛选
    vec0 = pts[1] - pts[0]
    vec1 = pts[2] - pts[1]
    vec2 = pts[3] - pts[1]
    if rg.Vector3d.VectorAngle(vec0,vec1) > rg.Vector3d.VectorAngle(vec0,vec2):#比较向量夹角
        pts[-1],pts[-2] = pts[-2],pts[-1]
        return get_quadrangle_from_sorted_points(pts)
    return get_quadrangle_from_sorted_points(pts)


def get_quadrangle_from_sorted_points(pts):
    #有序点得到四边形
    pl=rg.PolylineCurve(pts)
    pt_start=pl.PointAtStart
    pt_end=pl.PointAtEnd 
    
    return rg.Curve.JoinCurves([pl,rg.PolylineCurve([pt_start,pt_end])])

a=get_quadrangle_from_random4_points(pts)
# ---------- end python ----------
join = BrepJoin(Breps=arrlinear.Geometry)  # -> Breps, Closed

太阳高度角 = Slider(37.5, range=0..90)
crv = Curve(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)
光源 = GhPythonScript(rec=crv, D=太阳高度角)  # -> a; inputs rec: Rectangle3d
# ---------- 光源: Python ----------
import Rhino.Geometry as rg
import math


a=rec.ToNurbsCurve()
a.Rotate(- math.pi * D / 180,rec.Plane.YAxis,rec.Center)
# ---------- end 光源 ----------

move_3 = Move(Geometry=光源, Motion=X_2)  # -> Geometry, Transform

srf = Surface(move_3.Geometry)
入射光 = GhPythonScript(srf=srf, pt=pt_3)  # -> rayVec, pts; inputs srf: Surface, pt: Point3d
# ---------- 入射光: Python ----------
import Rhino.Geometry as rg
import math


def generate_ray_vector(srf,pt):
    #根据反射板单元角点生成入射光线.返回入射单元向量
    plane=srf.TryGetPlane()[1]
    pt_on_plane=plane.ClosestPoint(pt)
    inVec=pt - pt_on_plane
    inVec.Unitize()
    return inVec



rayVec=generate_ray_vector(srf,pt)
# ---------- end 入射光 ----------

# ----
# 光线路径
length = Slider(16, range=0..100)
入射光_2 = GhPythonScript(srf=srf, u_count=Slider(11, range=0..100), v_count=Slider(7, range=0..100), L=length)  # -> rays; inputs srf: Surface, u_count: Int32, v_count: Int32
# ---------- 入射光_2: Python ----------
import Rhino.Geometry as rg
import math

def generate_rays_from_border(srf,u_count,v_count,l):
    #通过生成点阵，在曲面上生成入射光线
    pts=[]
    vec_lst=[]
    rays=[]
    u_step = srf.Domain(0).T1 / u_count
    v_step = srf.Domain(1).T1 / v_count
    for i in range(0,u_count + 1):
        for j in range(0,v_count + 1):
            pt = srf.PointAt(u_step * i,v_step * j)
            vec = srf.NormalAt(u_step * i,v_step * j)
            rays.append(rg.Line(pt,vec,l))
    return rays




def generate_ray_vector(srf,pt):
    #根据反射板单元角点生成入射光线.返回入射单元向量
    plane=srf.TryGetPlane()[1]
    pt_on_plane=plane.ClosestPoint(pt)
    inVec=pt - pt_on_plane
    inVec.Unitize()
    return inVec



rays=generate_rays_from_border(srf,u_count,v_count,L)
# ---------- end 入射光_2 ----------
反射光 = GhPythonScript(rays=入射光_2, panels=merge)  # -> reflected_rays; inputs rays: list of Curve, panels: list of Surface
# ---------- 反射光: Python ----------
import Rhino.Geometry as rg
import Rhino.RhinoDoc as doc
import math

tol=doc.ActiveDoc.ModelAbsoluteTolerance

def get_panel1_corner_point(srf):
    #得到panel1下边缘角点
    u1=srf.Domain(0).T0
    v1=srf.Domain(1).T0
    pt1=srf.PointAt(u1,v1)
    
    u2=srf.Domain(0).T1
    v2=srf.Domain(1).T0
    pt2=srf.PointAt(u2,v2)
    return pt1,pt2

def get_panel2_corner_point(srf):
    #得到panel2上边缘角点
    u1=srf.Domain(0).T1
    v1=srf.Domain(1).T1
    pt1=srf.PointAt(u1,v1)
    
    u2=srf.Domain(0).T0
    v2=srf.Domain(1).T1
    pt2=srf.PointAt(u2,v2)
    return pt1,pt2
    

def is_line_surface_intersect(crv,srf):
    #判断线和面是否相交
    events=rg.Intersect.Intersection.CurveSurface(crv,srf,tol,0.0)
    if events:
        return events[0]

def generate_reflected_rays_line(inRays,srf):
    #在一块panel上生成反射光线
    inVec=inRays[0].TangentAtStart
    outRays=[]
    for ray in inRays:
        event = is_line_surface_intersect(ray,srf)
        if event:
            pt = event.PointB
            u,v=srf.ClosestPoint(pt)[1:]
            norm=srf.NormalAt(u,v)
            outVec=inVec - 2 * (inVec * norm) * norm #反射向量
            outRays.append(rg.Line(pt,outVec,30)) #反射光线长度
    return outRays
    

def create_reflected_rayVec_from_panel(rayVec,panels,pts):
    #生成反射光线向量
    out_rayVecs=[]
    for i in range(len(panels)):
        if i == 0:
            out_rayVecs.append(create_reflected_rayVec_from_pt(rayVec,pts[0],panels[i]))
        else:
            out_rayVecs.append(create_reflected_rayVec_from_pt(rayVec,pts[-1],panels[i]))
    return out_rayVecs
    
def create_reflected_rayVec_from_pt(rayVec,pt,srf):
    u,v=srf.ClosestPoint(pt)[1:]
    norm=srf.NormalAt(u,v)
    out_rayVec=rayVec - 2 * (rayVec * norm) * norm
    return out_rayVec
    


def generate_reflected_rays(rayVec,panels,l):
    #生成反射光线
    pts=[]
    reflected_rays=[]
    pts.extend(get_panel1_corner_point(panels[0]))
    pts.extend(get_panel2_corner_point(panels[1]))
    out_rayVecs=create_reflected_rayVec_from_panel(rayVec,panels,pts)
    for i in range(len(pts)):
        if i <= 1:
            reflected_rays.append(rg.Line(pts[i],out_rayVecs[0],l))
        else:
            reflected_rays.append(rg.Line(pts[i],out_rayVecs[1],l))
    return reflected_rays


reflected_rays=[]
for panel in panels:
    reflected_rays.extend(generate_reflected_rays_line(rays,panel))
# ---------- end 反射光 ----------

length_2 = Slider(19.8, range=0..100)
反射光_2 = GhPythonScript(rayVec=入射光.rayVec, panels=merge, L=length_2)  # -> reflected_rays; inputs rayVec: Vector3d, panels: list of Surface
# ---------- 反射光_2: Python ----------
import Rhino.Geometry as rg
import Rhino.RhinoDoc as doc
import math


def get_panel_corner_points(srf):
    #得到panel角点
    pt1=srf.PointAt(srf.Domain(0).T0,srf.Domain(1).T0)
    pt2=srf.PointAt(srf.Domain(0).T1,srf.Domain(1).T0)
    pt3=srf.PointAt(srf.Domain(0).T1,srf.Domain(1).T1)
    pt4=srf.PointAt(srf.Domain(0).T0,srf.Domain(1).T1)
    return [pt1,pt2,pt3,pt4]
    


def is_line_surface_intersect(crv,srf):
    #判断线和面是否相交
    events=rg.Intersect.Intersection.CurveSurface(crv,srf,tol,0.0)
    if events:
        return events[0]
    

def create_reflected_rayVec(in_rayVec,srf):
    #生成反射光线向量
    pt=get_panel_corner_points(srf)[0]
    u,v=srf.ClosestPoint(pt)[1:]
    norm=srf.NormalAt(u,v)
    out_rayVec=in_rayVec - 2 * (in_rayVec * norm) * norm
    return out_rayVec


def generate_reflected_rays(in_rayVec,panels,l):
    #生成反射光线
    reflected_rays=[]
    for panel in panels:
        out_rayVec=create_reflected_rayVec(in_rayVec,panel)
        pts=get_panel_corner_points(panel)
        for pt in pts:
            reflected_rays.append(rg.Line(pt,out_rayVec,l))
    return reflected_rays



reflected_rays=generate_reflected_rays(rayVec,panels,L)
# ---------- end 反射光_2 ----------
指标 = GhPythonScript(inVec=入射光.rayVec, panels=merge, w=width)  # -> area; inputs inVec: Vector3d, panels: list of Surface
# ---------- 指标: Python ----------
import Rhino.Geometry as rg
import math


def get_panel_corner_points(srf):
    #得到panel角点
    pt1=srf.PointAt(srf.Domain(0).T0,srf.Domain(1).T0)
    pt2=srf.PointAt(srf.Domain(0).T1,srf.Domain(1).T0)
    pt3=srf.PointAt(srf.Domain(0).T1,srf.Domain(1).T1)
    pt4=srf.PointAt(srf.Domain(0).T0,srf.Domain(1).T1)
    return [pt1,pt2,pt3,pt4]

pt1=get_panel_corner_points(panels[0])[0] #panel1低点
pt2=get_panel_corner_points(panels[1])[3] #panel2高点
vec=pt1 - pt2 #反射板正切方向向量

if( rg.Vector3d.CrossProduct(inVec,vec).Y < 0):#太阳高度角过低，没有反射面积
    area = 0
    print("Zero")
else:
    plane=rg.Plane(pt2,inVec)
    l = math.sqrt(vec.Length ** 2 - plane.DistanceTo(pt1) ** 2) #有效长度
    area=l * w
# ---------- end 指标 ----------
srf_2 = Surface(join.Breps)
反射板有效接受面积 = Panel(指标)
反射区域 = GhPythonScript(rays=反射光_2, panel=srf_2)  # -> regions, area; inputs rays: list of Curve, panel: Surface
# ---------- 反射区域: Python ----------
import Rhino.Geometry as rg
import Rhino.RhinoDoc as doc
import math

tol=doc.ActiveDoc.ModelAbsoluteTolerance

def is_line_surface_intersect(crv,srf):
    #判断线和面是否相交
    events=rg.Intersect.Intersection.CurveSurface(crv,srf,tol,0.0)
    if events:
        return events[0]
        
def create_reflected_region(srf,crvs):
    #创建矩形反射区域
    pts=[]
    for crv in crvs:
        events=rg.Intersect.Intersection.CurveSurface(crv,srf,tol,0.0)
        if events:
            event=events[0]
            pts.append(event.PointA)
    if len(pts) == 4:
        plane=srf.TryGetPlane()[1]
        return rg.Rectangle3d(plane,pts[0],pts[2])
    
def get_valid_area(inVec,rec):
    #根据入射向量得到有效投影面积
    pt_low ,pt_high,pt_high_par= rec.Corner(0),rec.Corner(3),rec.Corner(2)
    vec = pt_high - pt_low
    
    plane=rg.Plane(pt_low,inVec)
    l = math.sqrt(vec.Length ** 2 - plane.DistanceTo(pt_high) ** 2) #有效长度
    w = pt_high.DistanceTo(pt_high_par)
    return l * w
    
    
regions=[]
rays1=rays[:4]
rays2=rays[4:]

rec1=create_reflected_region(panel,rays1)
rec2=create_reflected_region(panel,rays2)
regions.append(rec1)
regions.append(rec2) #反射投影面积

inVec=rays[0].TangentAtStart
area=0
for rec in regions:
    if rec:
        area += get_valid_area(inVec,rec) #太阳板有效接受面积
# ---------- end 反射区域 ----------
光伏板有效接受面积 = Panel(反射区域.area)
