# Grasshopper definition 建造毫米.gh (Grasshopper 1.0.7)
# plug-ins: Human

# ---- group: 模拟结果
太阳高度角 = Slider(81, range=34..81)
最优解 = Panel("""34 205.3 455.4
35 205.3 455.4
36 207.3 457.9
37 208.3 461
38 209.3 464.2
39 210.3 467.3
40 214.2 476
41 215.2 479.1
42 216.2 482.2
43 218.2 488.5
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""")
c_script = CSharpScript(data=最优解, angle=太阳高度角)  # -> out, length, list1, list2; inputs data: list of String, angle: Int32
# ---------- c_script: C# ----------
    var length1 = new List<String>();
    var length2 = new List<String>();

    foreach(var i in data)
    {
      var s = i.Split(' ');
      length1.Add(s[1]);
      length2.Add(s[2]);
    }


    list1 = length1;
    list2 = length2;


    var index = angle - 34;
    var item = data[index];
    var result = item.Split(' ');


    length = result[1] + "  " + result[2];
# ---------- end c_script ----------
bnd = Bounds(Numbers=c_script.list2)
bnd_2 = Bounds(Numbers=c_script.list1)
阈值区间 = Panel("""205.3-215.2  455.4-500.5
215.2-225.2  XXXXX-543.6
225.2-235.2  XXXXX-589.8
235.2-245.3  XXXXX-639.5
245.3-255.5  XXXXX-693.1
255.5-265.7  XXXXX-750.9
265.7-305.0  XXXXX-755.0""")
panel = Panel(c_script.length)
panel_2 = Panel([bnd_2, bnd])

# ----
基准线 = Curve(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)

# ---- group: 保存图片
panel_3 = Panel("-3.jpg")
dam = DataDam(DataA=太阳高度角, BufferDelay=10000000, BufferMode=0)
concat = Concatenate(FragmentA=dam, FragmentB="-2.jpg")
c_script_2 = CSharpScript(RUN=Button(), path=concat)  # -> out; inputs RUN: Boolean, path: String; disabled
# ---------- c_script_2: C# usings ----------
using System.Drawing;
# ---------- c_script_2: C# ----------
    //    var port = Rhino.RhinoDoc.ActiveDoc.Views.ActiveView.ActiveViewport.;

    var view = Rhino.RhinoDoc.ActiveDoc.Views.ActiveView;
    var img = view.CaptureToBitmap(new Size(800, 500), false, false, false);
    img.Save(path);
    img.Dispose();
# ---------- end c_script_2 ----------

# ---- group: 导出json文件
python = GhPythonScript(data=最优解)  # -> out; inputs data: list; disabled
# ---------- python: Python ----------
import json
from collections import defaultdict

dict = defaultdict(list)

alts = [string.split(' ')[0] for string in data]

#for i in range(len(data)):
#    key = alts[i]
#    dict[key] = data[i].split(' ')[1:]
#
#with open("length.json","w") as f:
#    json.dump(dict,f,indent = 4)
# ---------- end python ----------

# ---- group: 导出webdata
旋转角度 = Panel(""" 0.0 0.0
 0.0 0.0
 0.8 0.1
 1.2 0.9
 1.6 1.7
 2.0 2.4
 3.6 3.2
 4.0 3.7
 4.4 4.2
 5.2 5.2
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""")
concat_2 = Concatenate(FragmentA=最优解, FragmentB=旋转角度)
panel_4 = Panel(concat_2)
python_2 = GhPythonScript(data=concat_2)  # -> out, a; inputs data: list; disabled
# ---------- python_2: Python ----------
import json
from collections import defaultdict

dict = defaultdict(list)

alts = [string.split(' ')[0] for string in data]
for i in range(len(data)):
    key = alts[i]
    dict[key] = data[i].split(' ')[1:]
    
with open("webdata.json","w") as f:
    json.dump(dict,f,indent=4)
# ---------- end python_2 ----------

# ----
galapagos = Galapagos(fitness=c_script_8, gene=[伪_伸缩杆1长度参数, 伪_伸缩杆2长度参数])

# ----
# 全年逐小时太阳高度角数据
_1月 = Panel("""9
19
27
33
35
34
29
21
12
1
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""")
_2月 = Panel("""11
22
31
37
41
40
35
27
18
7
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""")
_3月 = Panel("""17
29
39
46
50
49
43
35
24
12
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""")
_4月 = Panel("""26
38
49
58
62
60
52
41
29
17
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""")
_5月 = Panel("""33
45
57
68
73
69
58
46
34
21
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""")
_6月 = Panel("""36
48
61
73
80
74
62
50
37
24
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""")
_7月 = Panel("""35
48
60
72
81
76
64
51
39
26
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""")
_8月 = Panel("""32
45
57
69
76
72
62
50
37
24
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""")
_9月 = Panel("""29
41
53
62
66
63
54
43
31
18
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""")
_10月 = Panel("""12
24
36
46
53
55
52
44
34
22
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""")
_11月 = Panel("""7
18
29
37
42
44
41
34
25
14
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""")
_12月 = Panel("""12
22
30
35
36
34
28
20
10
0
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""")

entwine = Entwine(
    Branch00=_1月,
    Branch01=_2月,
    Branch02=_3月,
    Branch03=_4月,
    Branch04=_5月,
    Branch05=_6月,
    Branch06=_7月,
    Branch07=_8月,
    Branch08=_9月,
    Branch09=_10月,
    Branch010=_11月,
    Branch011=_12月,
    FlattenInputs=True)  # -> simplify(Result)

# ---- group: 导出json文件
python_3 = GhPythonScript(data=entwine)  # -> out; inputs data: tree; disabled
# ---------- python_3: Python ----------
import json
from collections import defaultdict
from functools import partial


def dict_from_list(list_data):
    #Create a month's worth of data from the list
    dict = defaultdict(list)
    count = 10  #10 data one day
    days_data = [list_data[i : i + count] for i in range(0,len(list_data),count)]#Break it down into daily data
    
    for i in range(len(days_data)):
        dict[i] = list(days_data[i])
        
    return dict


def dict_from_tree(tree_data):
    #Create a year's worth of data from the tree
    dict = defaultdict(partial(defaultdict,list))
    for i in range(tree_data.BranchCount):
        dict[i] = dict_from_list(tree_data.Branch(i))
        
    return dict


dict = dict_from_tree(data)
with open("altitude.json","w") as f:
    json.dump(dict,f,indent = 4)
# ---------- end python_3 ----------

# ----
# 模拟部分
距光伏板底边线垂直距离 = Panel("52")
距光伏板水平距离 = Panel("71")
伪_伸缩杆1长度参数 = Slider(0, range=0..1)
杆板1交点位置参数 = Panel("0.25")
c_script_3 = CSharpScript(baseCurve=基准线, vertDist=距光伏板底边线垂直距离, horiDist=距光伏板水平距离)  # -> out, A; inputs baseCurve: Line, vertDist: Double, horiDist: Double
# ---------- c_script_3: C# ----------
    var trans1 = Transform.Translation(new Vector3d(0,0,-vertDist));
    var trans2 = Transform.Translation(new Vector3d(0,-horiDist,0));
    
    baseCurve.Transform(trans1);
    baseCurve.Transform(trans2);
    
    A = baseCurve;
# ---------- end c_script_3 ----------
反射板1旋转轴 = Line(c_script_3.A)
伪_伸缩杆2长度参数 = Slider(0, range=0..1)
杆板2交点位置参数 = Panel("0.364")
向上偏移距离 = Slider(223, range=0..1000)
pt = Point(Point(-749.6508102, 498.0105901, 2236.337855))
c_script_4 = CSharpScript(centerPt=pt, dist=向上偏移距离)  # -> out, A; inputs centerPt: Point3d, dist: Double
# ---------- c_script_4: C# ----------
    var trans = Transform.Translation(new Vector3d(0,0,dist));
    centerPt.Transform(trans);
    
    var plane = new Plane(centerPt,new Vector3d(0,-1,0));
    var rec = new Rectangle3d(plane,new Interval(-76,76),new Interval(-750,750));
    
    A = rec;
# ---------- end c_script_4 ----------
光伏板墙 = Surface(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)
光伏单元 = Surface(c_script_4.A)
rec = Rectangle(光伏板墙)
number_slider = Slider(2.1, range=0..10)

# ---- group: 阵列数量
数量 = Slider(1, range=0..20)
random = Random(Range=Domain(0.2, 0.8), Number=数量, Seed=2)  # -> graft(Random)
random_2 = Random(Range=Domain(0.2, 0.6), Number=数量, Seed=2)  # -> graft(Random)
dup = DuplicateData(Data=反射板1旋转轴, Number=数量, Order=True)  # -> graft(Data)

# ----
dup_2 = DuplicateData(Data=Slider(0.3, range=0..1), Number=数量, Order=True)  # -> graft(Data)
dup_3 = DuplicateData(Data=Slider(0.45, range=0..1), Number=数量, Order=True)  # -> graft(Data)

c_script_5 = CSharpScript(rotateAxis=反射板1旋转轴, t1=dup_2, t2=杆板1交点位置参数)  # -> out, A, B, C, D, E, F; inputs rotateAxis: Line, t1: Double, t2: Double
# ---------- c_script_5: C# usings ----------
using System.Linq;
# ---------- c_script_5: C# ----------
    var axisMidPt = new Point3d((rotateAxis.FromX + rotateAxis.ToX) / 2, rotateAxis.FromY, rotateAxis.FromZ);//旋转轴的中点
    var rodFixedPt = GetRodFixedPt(vertDist, rotateAxis, t2, rodLengthInterval, axisMidPt);
    var rodLength = rodLengthInterval.Min + (rodLengthInterval.Max - rodLengthInterval.Min) * t1;
    var pseudoJointPt = GetJointPoint(rotateAxis, rodLength, rodFixedPt, t2, axisMidPt);//伪杆板交点

    var vec = pseudoJointPt - axisMidPt;
    vec.Unitize();//反射板方向向量

    var panelEdgeMidPt = GetRealPanelEdgeMidPt(axisMidPt, vec);//反射板边缘中点
    var panel = GetPanel(panelEdgeMidPt, vec, panelWidth, panelLength);//反射板1

    var angle = ComputeRotateAngleRadians(panel);//反射板1旋转角度
    var realJointPt = GetRealJointPt(panel, pseudoJointPt);//铰接点

    var axis2 = GetSecondAxis(angle, rotateAxis, axisMidPt);//第二个旋转轴
    var rod1 = new Line(rodFixedPt, realJointPt);//伸缩杆1

    rod1Length = Math.Round(rod1.Length, 1);

    //Output
    A = rodFixedPt;//伸缩杆杆1固定点
    B = panel;//反射板1
    C = realJointPt;//杆板铰接点
    D = axis2;//反射板2旋转轴
    E = rod1;//伸缩杆1
    F = angle;//反射板1旋转角度
    Print(rod1Length.ToString());
# ---------- c_script_5: C# additional code ----------
  Interval rodLengthInterval = new Interval(226, 320);//(伪)伸缩杆1长度区间,比真实区间要大，真实(205，305)
  double panelLength = 800;//反射板长度
  double panelWidth = 1500; //反射板宽度
  double axisToPanel = 13.4;//旋转轴距离反射板边缘垂直距离
  double panelThickness = 1; //反射板厚度
  double barThickness = 20;//型材厚度
  double vertDist = 145; //杆1固定点距旋转轴垂直距离
  double jointAxisToPanel = 25;//大杆板铰接点旋转轴距离反射板边缘垂直距离

  double rod1Length;//杆1真实长度


  public Point3d GetRodFixedPt(double vertDist, Line axis, double t, Interval rodLengthInterval, Point3d axisMidPt)
  {
    //根据杆板交点位置参数以及杆距离旋转轴的垂直距离，求杆的固定端点
    //t为杆板位置参数

    double rodBaseLength = rodLengthInterval.Min; //(伪)伸缩杆的基础长度
    var projected_length = Math.Sqrt(Math.Pow(rodBaseLength, 2) - Math.Pow(vertDist, 2));

    if(projected_length < panelLength * t + axisToPanel)
    {
      var rodFixedPt = new Point3d(axisMidPt.X, axisMidPt.Y - (panelLength * t + axisToPanel - projected_length), axisMidPt.Z - vertDist);
      return rodFixedPt;
    }
    else
    {
      var rodFixedPt = new Point3d(axisMidPt.X, axisMidPt.Y + (projected_length - panelLength * t - axisToPanel), axisMidPt.Z - vertDist);
      return rodFixedPt;
    }
  }


  public Point3d GetJointPoint(Line axis, double rodLength, Point3d rodFixedPoint, double t, Point3d axisMidPt)
  {
    //根据反射板的旋转轴，得到反射板与伸缩杆的交叉点
    //t值控制交叉点相对于板中线的位置，反射板的固定尺寸为1500*800
    var rPanel = panelLength * t + axisToPanel;
    var intersect = GetIntersectPoint(axisMidPt, rodFixedPoint, rPanel, rodLength);
    return intersect;
  }

  public Point3d GetIntersectPoint(Point3d pt1, Point3d pt2, double r1, double r2)
  {
    //以两个点为圆心，以给定距离为半径画圆，求交叉点
    var c1 = new Circle(Plane.WorldYZ, pt1, r1);
    var c2 = new Circle(Plane.WorldYZ, pt2, r2);
    Point3d pt_inter1;
    Point3d pt_inter2;
    var result = Rhino.Geometry.Intersect.Intersection.CircleCircle(c1, c2, out pt_inter1, out pt_inter2);

    //排序点,获取所需相交点
    List<Point3d> ptList = new List<Point3d>();
    ptList.Add(pt_inter1);
    ptList.Add(pt_inter2);
    ptList = ptList.OrderBy(pt => pt.Y).ToList();
    var pt_intersect = ptList[0];
    return pt_intersect;
  }

  public Point3d GetRealPanelEdgeMidPt(Point3d axisMidPt, Vector3d vector)
  {

    //得到真正反射板的边缘中点
    //vec为反射板单位方向向量
    var vec = new Vector3d(vector);
    var trans1 = Transform.Translation(vec * axisToPanel);
    axisMidPt.Transform(trans1);
    vec.Rotate(-Math.PI / 2, new Vector3d(1, 0, 0));
    var trans2 = Transform.Translation(vec * (barThickness / 2 + panelThickness));
    axisMidPt.Transform(trans2);
    return axisMidPt;
  }

  public Rectangle3d GetPanel(Point3d pt, Vector3d vec, double width, double length)
  {
    //创建反射板
    var newVec = vec * (length / 2);
    var newPt = pt + newVec;//反射板中心点

    var vec1 = new Vector3d(vec);
    var vec2 = new Vector3d(vec);
    vec.Rotate(Math.PI / 2, new Vector3d(1, 0, 0));

    vec1.Rotate(Math.PI / 2, vec);
    var plane = new Plane(newPt, vec1, vec2);//构造反射板平面

    var wInterval = new Interval(-width / 2, width / 2);
    var lInterval = new Interval(-length / 2, length / 2);
    var rec = new Rectangle3d(plane, wInterval, lInterval);
    return rec;
  }

  public double ComputeRotateAngleRadians(Rectangle3d panel)
  {
    //计算旋转角度,与水平方向夹角
    var plane = panel.Plane;
    var norm = plane.Normal;
    var angle = Vector3d.VectorAngle(norm, new Vector3d(0, 1, 0));
    return Math.PI / 2 - angle;
  }

  public Point3d GetRealJointPt(Rectangle3d panel, Point3d pseudoPt)
  {
    //根据panel平面法线向量，得到真正的杆板铰接点
    var realJointPtToPseudoJointPtDist = jointAxisToPanel + barThickness / 2;

    var plane = panel.Plane;
    var norm = plane.Normal;

    var vec = norm * realJointPtToPseudoJointPtDist;
    vec.Reverse();


    //    var vec = new Vector3d(0, 0, realJointPtToPseudoJointPtDist);
    //    vec.Rotate(angle, new Vector3d(1, 0, 0));
    //    vec.Reverse();
    var trans = Transform.Translation(vec);
    pseudoPt.Transform(trans);

    return pseudoPt;
  }

  public Line GetSecondAxis(double angle, Line originalAxis, Point3d axisMidPt)
  {
    //得到第二个反射板的旋转轴
    var trans1 = Transform.Translation(new Vector3d(0, -panelLength - axisToPanel * 2, 0));
    originalAxis.Transform(trans1);//第二个板旋转轴水平位置
    var trans2 = Transform.Rotation(-angle, new Vector3d(1, 0, 0), axisMidPt);
    originalAxis.Transform(trans2);//旋转
    return originalAxis;
  }
# ---------- end c_script_5 ----------
c_script_6 = CSharpScript(rod1FixedPt=c_script_5.A, rotateAxis=c_script_5.D, t1=dup_3, t2=杆板2交点位置参数)  # -> out, A, B, C, D, E; inputs rod1FixedPt: Point3d, rotateAxis: Line, t1: Double, t2: Double
# ---------- c_script_6: C# ----------
    var axisMidPt = new Point3d((rotateAxis.FromX + rotateAxis.ToX) / 2, rotateAxis.FromY, rotateAxis.FromZ);//旋转轴的中点
    var rodFixedPt = new Point3d(rod1FixedPt.X, rod1FixedPt.Y - dist, rod1FixedPt.Z);
    var rodLength = rodLengthInterval.Min + (rodLengthInterval.Max - rodLengthInterval.Min) * t1;
    var pseudoJointPt = GetJointPoint(rotateAxis, rodLength, rodFixedPt, t2, axisMidPt);//伪杆板交点

    var vec = pseudoJointPt - axisMidPt;
    vec.Unitize();//反射板方向向量

    var panelEdgeMidPt = GetRealPanelEdgeMidPt(axisMidPt, vec);//反射板边缘中点
    var panel = GetPanel(panelEdgeMidPt, vec, panelWidth, panelLength);//反射板1

    var angle = ComputeRotateAngleRadians(panel);//反射板2旋转角度
    var realJointPt = GetRealJointPt(panel, pseudoJointPt);//铰接点
    var rod2 = new Line(rodFixedPt, realJointPt);//伸缩杆1
    rod2Length = Math.Round(rod2.Length, 1);


    //Output
    A = rodFixedPt;//伸缩杆2固定点
    B = panel;//反射板2
    C = realJointPt;//杆板铰接点
    D = rod2;//伸缩杆2
    E = angle;//反射板2旋转角度
    Print(rod2Length.ToString());
# ---------- c_script_6: C# additional code ----------
  Interval rodLengthInterval = new Interval(465, 800);//(伪)伸缩杆2长度区间,真实(455，755)
  double panelLength = 800;//反射板长度
  double panelWidth = 1500; //反射板宽度
  double axisToPanel = 13.4;//旋转轴距离反射板边缘垂直距离
  double panelThickness = 1; //反射板厚度
  double barThickness = 20;//型材厚度
  double rod2Length;//rod2长度
  double dist = 650;//两伸缩杆固定点水平距离
  double jointAxisToPanel = 25;//大杆板铰接点旋转轴距离反射板边缘垂直距离


  public Point3d GetJointPoint(Line axis, double rodLength, Point3d rodFixedPoint, double t, Point3d axisMidPt)
  {
    //根据反射板的旋转轴，得到反射板与伸缩杆的交叉点
    //t值控制交叉点相对于板中线的位置，反射板的固定尺寸为1500*800
    var rPanel = panelLength * t + axisToPanel;
    var intersect = GetIntersectPoint(axisMidPt, rodFixedPoint, rPanel, rodLength);
    return intersect;
  }

  public Point3d GetIntersectPoint(Point3d pt1, Point3d pt2, double r1, double r2)
  {
    //以两个点为圆心，以给定距离为半径画圆，求交叉点
    var c1 = new Circle(Plane.WorldYZ, pt1, r1);
    var c2 = new Circle(Plane.WorldYZ, pt2, r2);
    Point3d pt_inter1;
    Point3d pt_inter2;
    var result = Rhino.Geometry.Intersect.Intersection.CircleCircle(c1, c2, out pt_inter1, out pt_inter2);

    //排序点,获取所需相交点
    List<Point3d> ptList = new List<Point3d>();
    ptList.Add(pt_inter1);
    ptList.Add(pt_inter2);
    ptList = ptList.OrderBy(pt => pt.Y).ToList();
    var pt_intersect = ptList[0];
    return pt_intersect;
  }

  public Point3d GetRealPanelEdgeMidPt(Point3d axisMidPt, Vector3d vector)
  {

    //得到真正反射板的边缘中点
    //vec为反射板单位方向向量
    var vec = new Vector3d(vector);
    var trans1 = Transform.Translation(vec * axisToPanel);
    axisMidPt.Transform(trans1);
    vec.Rotate(-Math.PI / 2, new Vector3d(1, 0, 0));
    var trans2 = Transform.Translation(vec * (barThickness / 2 + panelThickness));
    axisMidPt.Transform(trans2);
    return axisMidPt;
  }

  public Rectangle3d GetPanel(Point3d pt, Vector3d vec, double width, double length)
  {
    //创建反射板
    var newVec = vec * (length / 2);
    var newPt = pt + newVec;//反射板中心点

    var vec1 = new Vector3d(vec);
    var vec2 = new Vector3d(vec);
    vec.Rotate(Math.PI / 2, new Vector3d(1, 0, 0));

    vec1.Rotate(Math.PI / 2, vec);
    var plane = new Plane(newPt, vec1, vec2);//构造反射板平面

    var wInterval = new Interval(-width / 2, width / 2);
    var lInterval = new Interval(-length / 2, length / 2);
    var rec = new Rectangle3d(plane, wInterval, lInterval);
    return rec;
  }

  public double ComputeRotateAngleRadians(Rectangle3d panel)
  {
    //计算旋转角度,与水平方向夹角
    var plane = panel.Plane;
    var norm = plane.Normal;
    var angle = Vector3d.VectorAngle(norm, new Vector3d(0, 1, 0));
    return Math.PI / 2 - angle;
  }

  public Point3d GetRealJointPt(Rectangle3d panel, Point3d pseudoPt)
  {
    //根据panel平面法线向量，得到真正的杆板铰接点
    var realJointPtToPseudoJointPtDist = jointAxisToPanel + barThickness / 2;

    var plane = panel.Plane;
    var norm = plane.Normal;

    var vec = norm * realJointPtToPseudoJointPtDist;
    vec.Reverse();


    //    var vec = new Vector3d(0, 0, realJointPtToPseudoJointPtDist);
    //    vec.Rotate(angle, new Vector3d(1, 0, 0));
    //    vec.Reverse();
    var trans = Transform.Translation(vec);
    pseudoPt.Transform(trans);

    return pseudoPt;
  }
# ---------- end c_script_6 ----------
merge = Merge(Data1=c_script_5.out, Data2=c_script_6.out)
merge_2 = Merge(Data1=c_script_5.B, Data2=c_script_6.B)
杆真实长度 = Panel(merge)
c_script_7 = CSharpScript(panels=merge_2, angle=太阳高度角)  # -> out, rays, reflected_rays, parameters; inputs panels: list of Rectangle3d, angle: Double
# ---------- c_script_7: C# ----------
    double[] param =new double[2];//太阳光入射角与反射光入射角余弦积
    var rays1 = new List<Line>();//反射光线
    var rays2 = new List<Line>();//入射光线

    for(int i = 0;i < panels.Count;i++)
    {
      Vector3d inVec;
      Vector3d outVec;
      GenerateInvecOutvec(angle, panels[i], out inVec, out outVec);

      inVec.Reverse();
      var alpha1 = Vector3d.VectorAngle(inVec, outVec, Plane.WorldYZ) / 2;//太阳光入射角
      var alpha2 = ComputeAngle(outVec);//反射光线入射角
      param[i] = Math.Cos(alpha1) * Math.Cos(alpha2);


      var lines1 = GenerateRay(panels[i], outVec);//生成反射光线
      var lines2 = GenerateRay(panels[i], inVec);//生成入射光线
      rays1.AddRange(lines1);
      rays2.AddRange(lines2);
    }

    //Output
    reflected_rays = rays1;
    rays = rays2;
    parameters = param;
# ---------- c_script_7: C# additional code ----------
  public void GenerateInvecOutvec(double angle, Rectangle3d rec, out Vector3d inVec, out Vector3d outVec)
  {
    //根据给定太阳高度角，生成入射向量，反射向量
    inVec = new Vector3d(0, 1, 0);
    inVec.Rotate(-Math.PI * angle / 180, new Vector3d(1, 0, 0));//入射向量
    var norm = rec.Plane.Normal;
    if(norm * inVec > 0)
    {
      norm.Reverse();
    }
    norm.Unitize();
    outVec = inVec - 2 * (inVec * norm) * norm;//反射向量

  }
  public List<Line> GenerateRay(Rectangle3d rec, Vector3d vec)
  {
    //生成指定向量方向的射线

    var rays = new List<Line>();
    for(int i = 0; i < 4;i++)
    {
      var pt = rec.Corner(i);
      var line = new Line(pt, vec, 10000);//10为设定射线长度
      rays.Add(line);
    }
    return rays;

  }
  public double ComputeAngle(Vector3d outVec)
  {
    //计算反射光线与光伏板的入射角
    var norm = new Vector3d(0, -1, 0);
    var outoutVec = outVec - 2 * (outVec * norm) * norm;//光伏板上的反射向量
    outVec.Reverse();
    return Vector3d.VectorAngle(outVec, outoutVec, Plane.WorldYZ) / 2;
  }
# ---------- end c_script_7 ----------
c_script_8 = CSharpScript(panels=merge_2, rays=c_script_7.reflected_rays, parameters=c_script_7.parameters, border=rec)  # -> out, regions, energySum; inputs panels: list of Rectangle3d, rays: list of Line, parameters: list of Double, border: Rectangle3d
# ---------- c_script_8: C# ----------
    var plane = border.Plane;//光伏板所在平面
    var crvs = new List<Curve>();
    var areaProjected = new List<double>();//投影总面积

    var rec1 = GetRegionOnPlane(plane, rays.Take(4).ToList());
    var rec2 = GetRegionOnPlane(plane, rays.Skip(4).ToList());

    areaProjected.Add(rec1.Area);
    areaProjected.Add(rec2.Area);

    crvs.Add(rec1.ToNurbsCurve());
    crvs.Add(rec2.ToNurbsCurve());//获得初始区域

    for(int i = 0;i < crvs.Count;i++)
    {
      if(IsRegionValid(crvs[i], border, plane))
        continue;
      else
      {
        Curve curve;
        CreateCommonRegion(crvs[i], border, out curve);
        crvs[i] = curve;
      }
    }

    energy = ComputeEnergy(parameters, crvs, areaProjected);

    //Output
    regions = crvs;
    energySum = energy;
# ---------- c_script_8: C# additional code ----------
  double energy;
  public Rectangle3d GetRegionOnPlane(Plane plane, List<Line> lines)
  {
    //创建反射区域
    var pts = new List<Point3d>();
    foreach(var line in lines)
    {
      double t;
      Rhino.Geometry.Intersect.Intersection.LinePlane(line, plane, out t);
      pts.Add(line.PointAt(t));
    }
    return new Rectangle3d(plane, pts[0], pts[2]);

  }

  public bool IsRegionValid(Curve crv, Rectangle3d border, Plane plane)
  {
    //检查投影区域是否完全在光伏板内部
    var result = Curve.PlanarClosedCurveRelationship(crv, border.ToNurbsCurve(), plane, 0.01);
    if(result == RegionContainment.AInsideB) return true;
    return false;
  }

  public void CreateCommonRegion(Curve crv, Rectangle3d border, out Curve curve)
  {
    //投影区域与边框相交，返回相交区域
    var crvs = new List<Curve>();
    crvs.Add(crv);
    crvs.Add(border.ToNurbsCurve());
    curve = Curve.CreateBooleanIntersection(crv, border.ToNurbsCurve(), 0.01)[0];

  }

  public double ComputeEnergy(List<double> param, List<Curve> crvs, List<double> areas)
  {
    //计算光伏板得到的能量 energy = cos(alpha1) * cos(alpha2) * (S接受 / S投影)
    double sum = 0;
    for(int i = 0;i < crvs.Count;i++)
    {
      var area = AreaMassProperties.Compute(crvs[i]).Area;
      sum += param[i] * area / areas[i];
    }
    return sum;
  }


  //Return a BoundingBox that contains all the geometry you are about to draw.
  public override BoundingBox ClippingBox
  {
    get
    {
      return BoundingBox.Empty;
    }
  }

  //Draw all meshes in this method.
  public override void DrawViewportMeshes(IGH_PreviewArgs args)
  {
  }

  //Draw all wires and points in this method.
//  public override void DrawViewportWires(IGH_PreviewArgs args)
//  {
//    Point2d location = new Point2d(50, RhinoDocument.Views.ActiveView.Bounds.Height - 250);
//    args.Display.Draw2dText(
//      "Energy: " + Math.Round(energy, 5) + " \u03A6",
//      System.Drawing.Color.Black,
//      location,
//      false, 30);
//  }
# ---------- end c_script_8 ----------
panel_5 = Panel(c_script_8.energySum)
previewlw = CustomPreviewLineweights(Geometry=c_script_7.rays, Shader=ColourSwatch(SwatchColor=RGB(252, 114, 63)), Thickness=number_slider, Absolute=False)
previewlw_2 = CustomPreviewLineweights(
    Geometry=c_script_7.reflected_rays,
    Shader=ColourSwatch(SwatchColor=RGB(252, 208, 63)),
    Thickness=number_slider,
    Absolute=False)

data = Data(c_script_5.B)
data_2 = Data(c_script_6.B)

# ----
# 结构可视化部分
无中心铰接点单元1 = Geometry([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])  # disabled
无中心铰接点单元2 = Geometry([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])  # disabled
杆板铰接点 = Geometry(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)  # disabled
杆板铰接点_2 = Geometry(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)  # disabled
entwine_2 = Entwine(Branch00=杆板1交点位置参数, Branch01=杆板2交点位置参数, FlattenInputs=True)  # disabled
entwine_3 = Entwine(Branch00=无中心铰接点单元1, Branch01=无中心铰接点单元2, FlattenInputs=True)  # -> simplify(Result); disabled
entwine_4 = Entwine(Branch00=杆板铰接点, Branch01=杆板铰接点_2, FlattenInputs=True)  # disabled
c_script_9 = CSharpScript(joint=entwine_4, t=entwine_2)  # -> out, simplify(jointMoved); inputs joint: list of Brep, t: Double; disabled
# ---------- c_script_9: C# ----------
    var joint1 = MoveJoints(joint, t);


    //Output
    jointMoved = joint1;
# ---------- c_script_9: C# additional code ----------
  double panelLength = 800;//反射板长度

  public List<Brep> MoveJoints(List<Brep> breps, double t)
  {
    //根据t值，移动铰接点
    var brepMoved = new List<Brep>();
    var distance = panelLength * t;

    var vec = new Vector3d(0, -distance, 0);
    var trans = Transform.Translation(vec);
    foreach(var brep in breps)
    {
      brep.Transform(trans);
      brepMoved.Add(brep);
    }
    return brepMoved;
  }
# ---------- end c_script_9 ----------
merge_3 = Merge(Data1=entwine_3, Data2=c_script_9.jointMoved)  # disabled
bang = ExplodeTree(Data=merge_3)  # -> Branch0, Branch1; disabled
单元1目标旋转轴 = Curve(dup)  # disabled
单元2目标旋转轴 = Curve(c_script_5.D)  # disabled
单元2定位旋转轴 = Curve(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)  # disabled
单元1定位旋转轴 = Curve(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)  # disabled
单元1 = Geometry(bang.Branch0)  # disabled
单元2 = Geometry(bang.Branch1)  # disabled
c_script_10 = CSharpScript(rod1=c_script_5.E, rod2=c_script_6.D)  # -> out, A, B; inputs rod1: Line, rod2: Line; disabled
# ---------- c_script_10: C# ----------
    var rod1Pipe = CreateRods(rod1, rod1BaseLength);
    var rod2Pipe = CreateRods(rod2, rod2BaseLength);


    //Output
    //    A = rod1;
    //    B = rod2;
    A = rod1Pipe;
    B = rod2Pipe;
# ---------- c_script_10: C# additional code ----------
  double rod1BaseLength = 205;//伸缩杆1基础长度
  double rod2BaseLength = 455;//伸缩杆2基础长度
  double distance1 = 25; //伸缩杆基础长度中细杆长度部分
  double distance2 = 14; //伸缩杆粗杆底部长度
  double radius1 = 18; //伸缩杆粗杆半径
  double radius2 = 10;//伸缩杆细杆半径

  public List<Brep> CreateRods(Line rod, double rodBaseLength)
  {
    //创建伸缩杆
    var breps = new List<Brep>();
    var startPt = rod.From;
    var vec = rod.Direction;
    vec.Unitize();
    
    var breakPt1 = startPt + vec * (rodBaseLength - distance1);//伸缩杆粗杆与细杆分割点
    var breakPt2 = startPt + vec * distance2; //伸缩杆粗杆底部出头部分

    var seg1 = new Line(breakPt1, breakPt2);//粗杆部分
    var seg2 = new Line(breakPt1, rod.To);//细杆部分
    var seg3 = new Line(breakPt2,startPt);//出头部分

    var brep1 = Brep.CreatePipe(seg1.ToNurbsCurve(), radius1, true, PipeCapMode.Flat, false, 0.1, 0.01).ToList();
    var brep2 = Brep.CreatePipe(seg2.ToNurbsCurve(), radius2, true, PipeCapMode.Flat, false, 0.1, 0.01).ToList();
    var brep3 = Brep.CreatePipe(seg3.ToNurbsCurve(), radius2, true, PipeCapMode.Flat, false, 0.1, 0.01).ToList();
    
    breps.AddRange(brep1);
    breps.AddRange(brep2);
    breps.AddRange(brep3);
    return breps;

  }
# ---------- end c_script_10 ----------
flow = Flow(Geometry=单元1, Base=单元1定位旋转轴, Target=单元1目标旋转轴, ReverseBase=True, ReverseTarget=False, Stretch=False, Rigid=True)  # disabled
flow_2 = Flow(Geometry=单元2, Base=单元2定位旋转轴, Target=单元2目标旋转轴, ReverseBase=True, ReverseTarget=False, Stretch=False, Rigid=True)  # disabled
entwine_5 = Entwine(Branch00=c_script_5.F, Branch01=c_script_6.E, FlattenInputs=True)  # -> simplify(graft(Result)); disabled
entwine_6 = Entwine(Branch00=单元1目标旋转轴, Branch01=单元2目标旋转轴, FlattenInputs=True)  # -> simplify(graft(Result)); disabled
entwine_7 = Entwine(Branch00=flow, Branch01=flow_2, FlattenInputs=True)  # -> simplify(Result); disabled
merge_4 = Merge(Data1=c_script_10.A, Data2=c_script_10.B)  # disabled
swatch = ColourSwatch(SwatchColor=RGB(245, 245, 245))  # disabled

# ---- group: 阵列
entwine_8 = Entwine(Branch00=c_script_10.A, Branch01=c_script_10.B, FlattenInputs=True)  # disabled
entwine_9 = Entwine(Branch00=单元1, Branch01=单元2, FlattenInputs=True)  # disabled
panel_6 = Panel("3")  # disabled
partition = PartitionList(List=entwine_8, Size=panel_6)  # -> simplify(Chunks); disabled
lng = ListLength(List=entwine_9)  # disabled
partition_2 = PartitionList(List=entwine_7, Size=lng)  # disabled
tstat = TreeStatistics(Tree=partition)  # -> Paths, Length, Count; disabled
lng_2 = ListLength(List=tstat.Length)  # disabled
split = SplitList(List=tstat.Paths, Index=expr("X/2", lng_2))  # -> ListA, ListB; disabled
branch = TreeBranch(Tree=partition, Path=split.ListA, MaintainPaths=True)  # -> simplify(Branch); disabled
branch_2 = TreeBranch(Tree=partition, Path=split.ListB, MaintainPaths=True)  # -> simplify(Branch); disabled
merge_5 = Merge(Data1=branch, Data2=branch_2)  # disabled
panel_7 = Panel("1600")  # disabled
series = Series(Start=0, Step=panel_7, Count=数量)  # disabled
X = UnitX(Factor=expr("-X", series))  # disabled

# ----
c_script_11 = CSharpScript(unit=partition_2, axis=entwine_6, angle=entwine_5)  # -> out, A; inputs unit: list of Brep, axis: Line, angle: Double; disabled
# ---------- c_script_11: C# ----------
    var breps = RotateUnit(unit, angle, axis);


    //Output
    A = breps;
# ---------- c_script_11: C# additional code ----------
  public List<Brep> RotateUnit(List<Brep> unit, double angle, Line axis)
  {
    //旋转反射板单元
    var breps = new List<Brep>();
    var center = new Point3d((axis.FromX + axis.ToX) / 2, axis.FromY, axis.FromZ);
    var vec = new Vector3d(1, 0, 0);//旋转轴向量
    foreach(Brep brep in unit)
    {
      brep.Rotate(-angle, vec, center);
      breps.Add(brep);
    }
    return breps;
  }
# ---------- end c_script_11 ----------

# ---- group: 阵列 (continued)
tstat_2 = TreeStatistics(Tree=c_script_11.A)  # -> Paths, Length, Count; disabled
lng_3 = ListLength(List=tstat_2.Paths)  # disabled
split_2 = SplitList(List=tstat_2.Paths, Index=expr("x/2", lng_3))  # -> ListA, ListB; disabled
branch_3 = TreeBranch(Tree=c_script_11.A, Path=split_2.ListA, MaintainPaths=True)  # -> simplify(Branch); disabled
branch_4 = TreeBranch(Tree=c_script_11.A, Path=split_2.ListB, MaintainPaths=True)  # -> simplify(Branch); disabled
merge_6 = Merge(Data1=branch_3, Data2=branch_4)  # disabled
merge_7 = Merge(Data1=merge_5, Data2=merge_6)  # disabled
move = Move(Geometry=merge_7, Motion=graft(X))  # -> Geometry, Transform; disabled

# ----
preview = CustomPreview(Geometry=move.Geometry, Material=swatch)  # disabled

bang_2 = ExplodeTree(Data=move.Geometry)  # -> Branch0, Branch1; disabled
data_3 = Data(bang_2.Branch0)  # disabled
