# Grasshopper definition 插件版.gh (Grasshopper 1.0.7)
# plug-ins: SunLigthRef

基准线 = Curve(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)

# ---- group: 模拟结果
太阳高度角 = Slider(81, range=34..81)
最优解 = Panel("""34 205.3 455.4
35 205.3 455.4
36 207.3 457.9
37 208.3 461
38 209.3 464.2
39 210.3 467.3
40 214.2 476
41 215.2 479.1
42 216.2 482.2
43 218.2 488.5
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""")
da = DataAnalyze(OptimalDataSet=最优解, Altitudes=太阳高度角)  # -> Length, OptimalRod1Length, OptimalRod2Length
bnd = Bounds(Numbers=da.OptimalRod2Length)
bnd_2 = Bounds(Numbers=da.OptimalRod1Length)
阈值区间 = Panel("""205.3-215.2  455.4-500.5
215.2-225.2  XXXXX-543.6
225.2-235.2  XXXXX-589.8
235.2-245.3  XXXXX-639.5
245.3-255.5  XXXXX-693.1
255.5-265.7  XXXXX-750.9
265.7-305.0  XXXXX-755.0""")
panel = Panel([bnd_2, bnd])
panel_2 = Panel(da.Length)

# ---- group: 导出json文件
python = GhPythonScript(data=最优解)  # -> out; inputs data: list; disabled
# ---------- python: Python ----------
import json
from collections import defaultdict

dict = defaultdict(list)

alts = [string.split(' ')[0] for string in data]
for i in range(len(data)):
    key = alts[i]
    dict[key] = data[i].split(' ')[1:]

with open("length.json","w") as f:
    json.dump(dict,f,indent = 4)
# ---------- end python ----------

# ----
光伏板墙 = Surface(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)

# ----
# 模拟部分
距光伏板底边线垂直距离 = Panel("52")
距光伏板水平距离 = Panel("71")
伪_伸缩杆1长度参数 = Slider(0.68, range=0..1)
杆板1交点位置参数 = Panel("0.25")
bra = BaseRotateAxis(BaseLine=基准线, VertDist=距光伏板底边线垂直距离, HoriDist=距光伏板水平距离)
反射板1旋转轴 = Line(bra)
伪_伸缩杆2长度参数 = Slider(0.61, range=0..1)
杆板2交点位置参数 = Panel("0.364")
cfp = CalFirstPanel(RotateAxis=反射板1旋转轴, T1=伪_伸缩杆1长度参数, T2=杆板1交点位置参数)  # -> RodLength, Rod1FixedPt, Panel, JointPt, RotateAxis, Rod, Angle
csp = CalSecondPanel(Rod1FixedPt=cfp.Rod1FixedPt, RotateAxis=cfp.RotateAxis, T1=伪_伸缩杆2长度参数, T2=杆板2交点位置参数)  # -> RodLength, Rod2FixedPt, Panel, JointPt, Rod, Angle
merge = Merge(Data1=cfp.RodLength, Data2=csp.RodLength)
向上偏移距离 = Slider(223, range=0..1000)
merge_2 = Merge(Data1=cfp.Panel, Data2=csp.Panel)
杆真实长度 = Panel(merge)
pt = Point(Point(-749.6508102, 498.0105901, 2236.337855))
c_script = CSharpScript(centerPt=pt, dist=向上偏移距离)  # -> out, A; inputs centerPt: Point3d, dist: Double
# ---------- c_script: C# ----------
    var trans = Transform.Translation(new Vector3d(0,0,dist));
    centerPt.Transform(trans);
    
    var plane = new Plane(centerPt,new Vector3d(0,-1,0));
    var rec = new Rectangle3d(plane,new Interval(-76,76),new Interval(-750,750));
    
    A = rec;
# ---------- end c_script ----------
cst = CalSunTrace(Panels=merge_2, Altitude=太阳高度角)  # -> InRays, ReflectedRays, Params
光伏单元 = Surface(c_script.A)
rec = Rectangle(光伏板墙)
cr = CalResult(Panels=merge_2, InRays=cst.ReflectedRays, Params=cst.Params, SunPanel=rec)  # -> Region, Energy
panel_3 = Panel(cr.Energy)

# ----
# 结构可视化部分
无中心铰接点单元1 = Geometry([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])
无中心铰接点单元2 = Geometry([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])
杆板铰接点 = Geometry(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)
杆板铰接点_2 = Geometry(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)
entwine = Entwine(Branch00=杆板1交点位置参数, Branch01=杆板2交点位置参数, FlattenInputs=True)
entwine_2 = Entwine(Branch00=无中心铰接点单元1, Branch01=无中心铰接点单元2, FlattenInputs=True)  # -> simplify(Result)
entwine_3 = Entwine(Branch00=杆板铰接点, Branch01=杆板铰接点_2, FlattenInputs=True)
gj = GetJoint(OriginJoint=entwine_3, T=entwine)  # -> simplify(MovedJoint)
merge_3 = Merge(Data1=entwine_2, Data2=gj)
bang = ExplodeTree(Data=merge_3)  # -> Branch0, Branch1
单元2定位旋转轴 = Curve(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)
单元2目标旋转轴 = Curve(cfp.RotateAxis)
单元1定位旋转轴 = Curve(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)
单元1目标旋转轴 = Curve(反射板1旋转轴)
单元2 = Geometry(bang.Branch1)
单元1 = Geometry(bang.Branch0)
cr_2 = CreateRod(RodLine1=cfp.Rod, RodLine2=csp.Rod)  # -> Rod1, Rod2
flow = Flow(Geometry=单元1, Base=单元1定位旋转轴, Target=单元1目标旋转轴, ReverseBase=True, ReverseTarget=False, Stretch=False, Rigid=True)
flow_2 = Flow(Geometry=单元2, Base=单元2定位旋转轴, Target=单元2目标旋转轴, ReverseBase=True, ReverseTarget=False, Stretch=False, Rigid=True)
entwine_4 = Entwine(Branch00=flow, Branch01=flow_2, FlattenInputs=True)  # -> simplify(Result)
entwine_5 = Entwine(Branch00=单元1目标旋转轴, Branch01=单元2目标旋转轴, FlattenInputs=True)  # -> simplify(Result)
entwine_6 = Entwine(Branch00=cfp.Angle, Branch01=csp.Angle, FlattenInputs=True)  # -> simplify(Result)
merge_4 = Merge(Data1=cr_2.Rod1, Data2=cr_2.Rod2)
preview = CustomPreview(Geometry=merge_4, Material=ColourSwatch(SwatchColor=RGB(255, 255, 255)))
tu = TransformUnit(OriginUnit=entwine_4, RotateAxis=entwine_5, Angle=entwine_6)
preview_2 = CustomPreview(Geometry=tu, Material=ColourSwatch(SwatchColor=RGB(156, 156, 156)))

galapagos = Galapagos(gene=[伪_伸缩杆1长度参数, 伪_伸缩杆2长度参数])

# ----
# 全年逐小时太阳高度角数据
_1月 = Panel("""9
19
27
33
35
34
29
21
12
1
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""")
_2月 = Panel("""11
22
31
37
41
40
35
27
18
7
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""")
_3月 = Panel("""17
29
39
46
50
49
43
35
24
12
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""")
_4月 = Panel("""26
38
49
58
62
60
52
41
29
17
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""")
_5月 = Panel("""33
45
57
68
73
69
58
46
34
21
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""")
_6月 = Panel("""36
48
61
73
80
74
62
50
37
24
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""")
_7月 = Panel("""35
48
60
72
81
76
64
51
39
26
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""")
_8月 = Panel("""32
45
57
69
76
72
62
50
37
24
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""")
_9月 = Panel("""29
41
53
62
66
63
54
43
31
18
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""")
_10月 = Panel("""12
24
36
46
53
55
52
44
34
22
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""")
_11月 = Panel("""7
18
29
37
42
44
41
34
25
14
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""")
_12月 = Panel("""12
22
30
35
36
34
28
20
10
0
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""")

entwine_7 = Entwine(
    Branch00=_1月,
    Branch01=_2月,
    Branch02=_3月,
    Branch03=_4月,
    Branch04=_5月,
    Branch05=_6月,
    Branch06=_7月,
    Branch07=_8月,
    Branch08=_9月,
    Branch09=_10月,
    Branch010=_11月,
    Branch011=_12月,
    FlattenInputs=True)  # -> simplify(Result)

# ---- group: 导出json文件
python_2 = GhPythonScript(data=entwine_7)  # -> out; inputs data: tree; disabled
# ---------- python_2: Python ----------
import json
from collections import defaultdict
from functools import partial


def dict_from_list(list_data):
    #从列表创建一个月的数据
    dict = defaultdict(list)
    count = 10 #一天10个数据
    days_data = [list_data[i : i + count] for i in range(0,len(list_data),count)]#拆成每天的数据
    
    for i in range(len(days_data)):
        dict[i] = list(days_data[i])
        
    return dict


def dict_from_tree(tree_data):
    #从树创建一年的数据
    dict = defaultdict(partial(defaultdict,list))
    for i in range(tree_data.BranchCount):
        dict[i] = dict_from_list(tree_data.Branch(i))
        
    return dict


dict = dict_from_tree(data)

with open("altitude.json","w") as f:
    json.dump(dict,f,indent = 4)
# ---------- end python_2 ----------
